# Dynamo graph PAR-02-WRITE PARAMETER MULTI VALUE-210925.dyn "08-Write-Paramater-Multi-210506" (Dynamo 2.3.0.5885)

select_model_elements = DSModelElementsSelection()  # 24 picked in the model; graph input
code_block = CodeBlock(elem=select_model_elements) { elem; }
parameter_name = StringInput("COF_GEN__ProjectNumber")  # graph input
parameter_value = StringInput("MARS")  # graph input
setParameterByName = Element.SetParameterByName(element=code_block, parameterName=parameter_name, value=parameter_value)
parameter_name_2 = StringInput("COF_GEN__BuildingNumber")  # graph input
parameter_value_2 = StringInput("FAC")  # graph input
setParameterByName_2 = Element.SetParameterByName(element=code_block, parameterName=parameter_name_2, value=parameter_value_2)
parameter_name_3 = StringInput("COF_GEN__Level")  # graph input
parameter_value_3 = StringInput("01F")  # graph input
setParameterByName_3 = Element.SetParameterByName(element=code_block, parameterName=parameter_name_3, value=parameter_value_3)
parameter_name_4 = StringInput("COF_GEN__Category")  # graph input
parameter_value_4 = StringInput("GB")  # graph input
setParameterByName_4 = Element.SetParameterByName(element=code_block, parameterName=parameter_name_4, value=parameter_value_4)
help_level = StringInput("""Hầm	BA
TẦNG	
Hầm 01	01B
Hầm 02	02B
Tầng trệt	GF
Tầng 1	01F
Tầng 2	02F
Tầng 2 lững	02MF
Tầng 3	02F
Tầng 4	03F
Tầng 5	04F
Tầng 6	05F
Tầng 7	06F
Tầng 8	07F
Tầng 9	08F
Tầng 10	09F
Tầng 11	11F
Tầng 12	12F
Tầng 13	13F
Tầng 14	14F
Tầng 15	15F
Tầng mái	ROOF""")  # graph input
help_parameter = StringInput("""----COFICO parameter:
COF_GEN__ProjectNumber
COF_GEN__BuildingNumber
COF_GEN__ZoneArea
COF_GEN__Level
COF_GEN__Category 
COF_GEN__Description""")  # graph input
help_building_number = StringInput("""Tháp A	A
Tháp B	B
Tháp C	C
Podium	PO
Bể xử lý nước thải	STPT
Bể PCCC	FFT
Be nuoc	WT
Be xu li nuoc thai WWT""")  # graph input
