# Dynamo graph PAR-02-WRITE PARAMETER SINGLE VALUE-210925.dyn "07-INPUT-05-Comments" (Dynamo 2.3.0.5885)

select_model_elements = DSModelElementsSelection()  # 24 picked in the model; graph input
parameter_name = StringInput("COF_GEN__Category")  # graph input
parameter_value = StringInput("24/03/2021")  # graph input
setParameterByName = Element.SetParameterByName(element=select_model_elements, parameterName=parameter_name, value=parameter_value)
HELP = StringInput("""Móng bè: FD
Đà kiềng: GB
Cột: CL
DẦM: BM
SÀN: SL
VÁCH: SW
Cầu thang: ST""")  # graph input
