# Dynamo graph PAR-02-WRITE PARAMETER VALUE-210925.dyn "07-Write-Comments-210909" (Dynamo 2.1.0.7500)

help_bim_code = StringInput("""Móng bè: FD
Đà kiềng: GB
Cột: CL
DẦM: BM
SÀN: SL
VÁCH: SW
Cầu thang: ST
Dockleveler:DLV
Machine Base: MB""")  # graph input
select_model_elements = DSModelElementsSelection()  # 2 picked in the model; graph input
parameter_name_string_only = StringInput("COF_GEN__Level")  # graph input
parameter_value = StringInput("Machine Base")  # graph input
concentrate_with_deliemeter_y_n = BoolSelector(false)  # graph input
delimeter = StringInput(", ")  # graph input
python_lib_path = StringInput("K:\_BIM STANDARD\_DYNAMO_REVIT\210903\py_dynamo")  # graph input
python_script = Python(IN[0]=select_model_elements, IN[1]=parameter_name_string_only, IN[2]=parameter_value, IN[3]=concentrate_with_deliemeter_y_n, IN[4]=delimeter, IN[5]=python_lib_path)
# ---------- python_script.python (87 lines) ----------
# Load the Python Standard and DesignScript Libraries
import sys,os,json,tempfile
from shutil import copyfile
from json import *
import clr
clr.AddReference('ProtoGeometry')
from Autodesk.DesignScript.Geometry import *
clr.AddReference('RevitAPI')
from Autodesk.Revit.DB import *
clr.AddReference('RevitAPIUI')
from Autodesk.Revit.UI import TaskDialog
clr.AddReference("RevitNodes")
import Revit
clr.ImportExtensions(Revit.Elements)
clr.AddReference("RevitServices")
import RevitServices
from RevitServices.Persistence import DocumentManager
from RevitServices.Transactions import TransactionManager
from System.Collections.Generic import *
clr.ImportExtensions(Revit.GeometryConversion)

## add module director
"""
ip = "172.16.2.29"
domain = "hcmcfcfs01"
dynPyDir = ""
dynPyDir_ip = "\\\\{0}\\databim$\\BimESC\\00-BIM STANDARD\\PYTHON\\pythondynamo".format(ip)
dynPyDir_domain = "\\\\{0}\\databim$\\BimESC\\00-BIM STANDARD\\PYTHON\\pythondynamo".format(domain)

if os.path.exists(dynPyDir_domain):
	dynPyDir = dynPyDir_domain
	
if os.path.exists(dynPyDir_ip):
	dynPyDir = dynPyDir_ip
	
sys.path.append(dynPyDir)
import pyDyn
from pyDyn import *
"""
##
doc = DocumentManager.Instance.CurrentDBDocument
uiapp = DocumentManager.Instance.CurrentUIApplication
app = uiapp.Application
opt = Options()
categories = doc.Settings.Categories

# The inputs to this node will be stored as a list in the IN variables.
dataEnteringNode = IN

elements = UnwrapElement(IN[0])
param_name = IN[1]
write_value = IN[2]

flagConcentrate = IN[3]
delimeter = IN[4]

#setParameterValue(doc,elements,paramName,paramValue)
# Place your code below this line

TransactionManager.Instance.EnsureInTransaction(doc)
if flagConcentrate:	
	for e in elements:
		try:
			param = e.LookupParameter(param_name)
			if param.StorageType == StorageType.Double:
				raise Exception('Parameter not be string type')
			old_value = param.AsString()
			if not write_value.lower() in old_value.lower():
				new_value = old_value + delimeter + write_value
				param.Set(new_value)					
		except Exception as ex:
			pass
	
else:
	for e in elements:
		try:
			param = e.LookupParameter(param_name)
			if param.StorageType == StorageType.Double:
				raise Exception('Parameter not be string type')
			new_value = write_value
			param.Set(new_value)					
		except Exception as ex:
			pass
TransactionManager.Instance.TransactionTaskDone()
OUT = "OK"
# Assign your output to the OUT variable.
	
# ----------------------------------------
watch = Watch(python_script)  # graph output
