# Dynamo graph Grid_By_data_excel.dyn (Dynamo 2.1.0.7500)

file_path = Filename("K:\_WFH SHTP\LAND COORDINATES.xlsx")
file_from_path = FileObject(path=file_path)
sheet_name = StringInput("LEVEL")
boolean = BoolSelector(false)
importExcel = Data.ImportExcel(file=file_from_path, sheetName=sheet_name, readAsStrings=boolean, showExcel=boolean)
additional_ratio_multiply = DoubleInput(1)
python_script = Python(IN[0]=importExcel, IN[1]=additional_ratio_multiply)
# ---------- python_script.python (29 lines) ----------
# Load the Python Standard and DesignScript Libraries
import sys
import clr
clr.AddReference('ProtoGeometry')
from Autodesk.DesignScript.Geometry import *
# Import RevitNodes
clr.AddReference("RevitNodes")
import Revit
# Import Revit elements
from Revit.Elements import *

# The inputs to this node will be stored as a list in the IN variables.
dataEnteringNode = IN
data = IN[0]
ratio = IN[1]
result = []

for d in data[1:]:
	try:
		name = d[0]
		ele = float(d[1]*ratio)
		result.append(Level.ByElevationAndName(ele,name))
	except:
		pass
	
# Place your code below this line

# Assign your output to the OUT variable.
OUT = result
# ----------------------------------------
watch = Watch(python_script)
byLine = Grid.ByLine()  # unwired: line
byStartPointEndPoint = Grid.ByStartPointEndPoint()  # unwired: start, end
