# Dynamo graph Land_Boundary_By_Points_data_excel.dyn (Dynamo 2.1.0.7500)

file_path = Filename("K:\_WFH SHTP\LAND COORDINATES.xlsx")
file_from_path = FileObject(path=file_path)
sheet_name = StringInput("RANH DAT")
boolean = BoolSelector(false)
importExcel = Data.ImportExcel(file=file_from_path, sheetName=sheet_name, readAsStrings=boolean, showExcel=boolean)
additional_ratio_multiply = DoubleInput(1000)
python_script = Python(IN[0]=importExcel, IN[1]=additional_ratio_multiply)
# ---------- python_script.python (21 lines) ----------
# Load the Python Standard and DesignScript Libraries
import sys
import clr
clr.AddReference('ProtoGeometry')
from Autodesk.DesignScript.Geometry import *

# The inputs to this node will be stored as a list in the IN variables.
dataEnteringNode = IN
data_point = IN[0]
ratio = IN[1]
result = []

for d in data_point[1:]:
	x = d[4]*ratio
	y = d[3]*ratio
	result.append(Point.ByCoordinates(x,y))
	
# Place your code below this line

# Assign your output to the OUT variable.
OUT = PolyCurve.ByPoints(result,True)
# ----------------------------------------
watch = Watch(python_script)
curves = PolyCurve.Curves(polyCurve=python_script)
byCurve = ModelCurve.ByCurve(curve=curves)
