# Dynamo graph Type_Name_Change-211026.dyn (Dynamo 2.10.0.3455)

categories = StringInput("""Structural Foundations
Structural Columns
Structural Framing
Walls
Floors
Roofs
Doors
Windows
Parts""")
categories_2 = StringInput("Structural Columns")
param_1 = StringInput("b")
param_2 = StringInput("h")
python_script = Python(IN[0]=categories_2, IN[1]=param_1, IN[2]=param_2)  # IronPython2
# ---------- python_script.python (104 lines) ----------
import sys,os,re
import clr
clr.AddReference('ProtoGeometry')
from Autodesk.DesignScript.Geometry import *
clr.AddReference('RevitAPI')
from Autodesk.Revit.DB import *
clr.AddReference('RevitAPIUI')
from Autodesk.Revit.UI import TaskDialog
clr.AddReference("RevitNodes")
import Revit
clr.ImportExtensions(Revit.Elements)
clr.AddReference("RevitServices")
import RevitServices
from RevitServices.Persistence import DocumentManager
from RevitServices.Transactions import TransactionManager
from System.Collections.Generic import *
import Autodesk.Revit.DB.JoinGeometryUtils as JGU
import time



#functions
def setupUnit(doc):	
	try:
		#Area
		unit = Units(UnitSystem.Metric)		
		fmOp = FormatOptions(DisplayUnitType.DUT_SQUARE_METERS,UnitSymbolType.UST_NONE,0.001)		
		unit.SetFormatOptions(UnitType.UT_Area,fmOp)		
		doc.SetUnits(unit)
		#Volume
		unit1 = Units(UnitSystem.Metric)	
		fmOp1 = FormatOptions(DisplayUnitType.DUT_CUBIC_METERS,UnitSymbolType.UST_NONE,0.001)		
		unit.SetFormatOptions(UnitType.UT_Volume,fmOp1)		
		doc.SetUnits(unit)
		#doc.GetUnits().SetFormatOptions(UnitType.UT_Area,fmOp)
	except Exception as ex:
		pass
def revitDir(doc):
	dir = ""
	try:
		p = doc.PathName.split("\\")
		pp = p[0:len(p)-1]
	
		for s in pp:
			dir += s + "\\"
	except:
		pass
	return dir,doc.PathName.split("\\")[-1].split(".rvt")[0]
def getAllElementsOfCategories(doc,cates):
	global debugger
	categories = list(doc.Settings.Categories)
	category_names = [c.Name for c in categories]
	elements = []
	for cat in cates:
		try:
			if cat in category_names:
				c = categories[int(category_names.index(cat))]				
				elements.extend( [e for e in FilteredElementCollector(doc).OfCategoryId(c.Id).WhereElementIsNotElementType().ToElements()])
		except Exception as ex:
			debugger.append(ex)
			pass
	return elements

def collector(doc,cates,file_path,file_name):
	elements = getAllElementsOfCategories(doc,cates)
	for e in elements:
		try:
			debugger.append(e.UniqueId)
		except Exception as ex:
			pass
	content = ""
	list_ = []
	try:
		param = elements[0].LookupParameter(param_name)
		if param.StorageType == StorageType.String:
			for elem in elements:
				try:
					par = elem.LookupParameter(param_name)				
					if par.AsString() != None:
						list_.append("{0}\t{1}\t{2}\t{3}".format(elem.UniqueId,par.AsString(),file_name,elem.Id))
				except:
					pass
			content = "\n".join(list_)
	except:
		pass
	with open(file_path,"w") as f:
		f.write(content)
	return elements,list_

#start
time_start = time.strftime("%y%m%d %H:%M:%S",time.localtime(time.time()))
debugger = []
result = []
doc = DocumentManager.Instance.CurrentDBDocument
uiapp = DocumentManager.Instance.CurrentUIApplication
app = uiapp.Application

#excecute
cates = IN[0].splitlines()

#end
time_end = time.strftime("%y%m%d %H:%M:%S",time.localtime(time.time()))

OUT = "{0}/{1} Succeeded".format(len(list_),len(elements)),time_start, time_end
# ----------------------------------------
