# Dynamo graph View-Writting-211119.dyn (Dynamo 2.3.0.5885)

sheet_name_contains = StringInput("MODEL STATISTIC")
text_type_name_contains = StringInput("Rebar Info")
python_script = Python(IN[0]=sheet_name_contains, IN[1]=text_type_name_contains)
# ---------- python_script.python (102 lines) ----------
# Load the Python Standard and DesignScript Libraries
import sys
import clr
clr.AddReference('ProtoGeometry')
from Autodesk.DesignScript.Geometry import *
import Autodesk.DesignScript.Geometry.Point as pt
clr.AddReference('RevitAPI')
from Autodesk.Revit.DB import *
clr.AddReference('RevitAPIUI')
from Autodesk.Revit.UI import TaskDialog
clr.AddReference("RevitNodes")
import Revit
import Revit.Elements.TextNote as tn
clr.ImportExtensions(Revit.Elements)
clr.AddReference("RevitServices")
import RevitServices
from RevitServices.Persistence import DocumentManager
from RevitServices.Transactions import TransactionManager
from System.Collections.Generic import *
import Autodesk.Revit.DB.JoinGeometryUtils as JGU
import time
#----------------------------------------------------#
#----------------------------------------------------#
#----------------------------------------------------#
def get_sheet_view_by_search_string(search_string):
    global doc    
    viewCollector = list(FilteredElementCollector(doc).OfClass(ViewSheet))
    try:
	    view_  = [v for v in viewCollector if search_string in v.Name][0]
	    return view_
    except:
    	return
def get_textnote(view_):
	global doc , debugger,text_type
	text_collector = list(FilteredElementCollector(doc,view_.Id).OfClass(TextNote))
	dic_text = {}
	for t in text_collector:
		try:
			# Global Text Type:
			text_type = t.TextNoteType
			dic_text[str(t.Id)] = {}
			# GIÁ TRI TEXTNOTE		
			dic_text[str(t.Id)]["TextNoteValue"] = t.Text.strip()#GetFormattedText().GetPlainText().strip()				
			# GIÁ TRI TEXTNOTE LIST sep TAB
			dic_text[str(t.Id)]["TextNoteValueColumnList"] = []			
			dic_text[str(t.Id)]["TextNoteValueColumnList"].append(t.Text.strip().split("\t"))#GetFormattedText().GetPlainText().strip()	
			# ÐO DAI TEXTNOTE		
			text_type_border = t.TextNoteType.LookupParameter("Leader/Border Offset").AsDouble()*304.8			
			dic_text[str(t.Id)]["TextNoteWidth"] = ("{:0.0f}".format(round(t.Width*304.8 + 2*text_type_border)))			
			# TEXTNOTE TYPE
			dic_text[str(t.Id)]["TextNoteType"] = t.Name#GetFormattedText().GetPlainText().strip()				
			# TAB SIZE
			dic_text[str(t.Id)]["TextNoteTabSize"] = t.TextNoteType.LookupParameter("Tab Size").AsDouble()*304.8
			# TEXT SIZE
			dic_text[str(t.Id)]["TextNoteTextSize"] = t.TextNoteType.LookupParameter("Text Size").AsDouble()*304.8
			# TEXT FONT
			dic_text[str(t.Id)]["TextNoteFont"] = t.TextNoteType.LookupParameter("Text Font").AsString()
			# TEXT BOLD
			dic_text[str(t.Id)]["TextNoteBold"] = t.TextNoteType.LookupParameter("Bold").AsInteger()
			# TEXT ITALIC
			dic_text[str(t.Id)]["TextNoteItalic"] = t.TextNoteType.LookupParameter("Italic").AsInteger()
			# TEXT UNDERLINE
			dic_text[str(t.Id)]["TextNoteUnderline"] = t.TextNoteType.LookupParameter("Underline").AsInteger()
			# TEXT WIDTH FACTOR
			dic_text[str(t.Id)]["TextNoteWidthFactor"] = t.TextNoteType.LookupParameter("Width Factor").AsDouble()
		except Exception as ex:
			debugger.append(ex)
			pass
	return dic_text
#----------------------------------------------------#
#----------------------------------------------------#
#----------------------------------------------------#
debugger = []
doc = DocumentManager.Instance.CurrentDBDocument
uiapp = DocumentManager.Instance.CurrentUIApplication
app = uiapp.Application
opt = Options()
#----------------------------------------------------#
#----------------------------------------------------#
#----------------------------------------------------#

# The inputs to this node will be stored as a list in the IN variables.
dataEnteringNode = IN
view_name = IN[0]

dic = {	"a":{"d10":10,"d16":16,"d20":20},
		"b":{"d10":11,"d16":17,"d20":21},
		"c":{"d10":12,"d16":18,"d20":22}}

# TEXTNOTE TYPE
text_type = None


# GET VIEW SHEET
view_  = get_sheet_view_by_search_string(view_name)

# GET ALL TEXTNOTE
dic_text = get_textnote(view_)



OUT = view_,text_type
# ----------------------------------------
watch = Watch(python_script)
code_block = CodeBlock(res=python_script)
# ---------- code_block.designscript (7 lines) ----------
view = res[0];
point = Point.ByCoordinates(0,0);
text = "TEST";
align = "Left";
text_type = res[1];
keep_rot = false;
rot = 0;
# ----------------------------------------
byLocation = TextNote.ByLocation(view=code_block.view, location=code_block.point, text=code_block.text, alignment=code_block.align, type=code_block.text_type, keepRotatedTextReadable=code_block.keep_rot, rotation=code_block.rot)  # frozen
data = StringInput("""{"a":{"d10":10,"d16":16,"d20":20},
		"b":{"d10":11,"d16":17,"d20":21},
		"c":{"d10":12,"d16":18,"d20":22}}""")
file_path = Filename("..\rebar\rebar_data.xlsx")
file_from_path = FileObject(path=file_path)
code_block_2 = CodeBlock { "Rebar Weight"; false; }
importExcel = Data.ImportExcel(file=file_from_path, sheetName=code_block_2.out0, readAsStrings=code_block_2.out1, showExcel=code_block_2.out1)
python_script_massive_write = Python(IN[0]=data, IN[1]=code_block.view, IN[2]=code_block.text_type, IN[3]=importExcel)  # "Python Script-Massive Write Textnote"
# ---------- python_script_massive_write.python (85 lines) ----------
# Load the Python Standard and DesignScript Libraries
import sys
import clr
clr.AddReference('ProtoGeometry')
from Autodesk.DesignScript.Geometry import *
import Autodesk.DesignScript.Geometry.Point as pt
clr.AddReference('RevitAPI')
from Autodesk.Revit.DB import *
clr.AddReference('RevitAPIUI')
from Autodesk.Revit.UI import TaskDialog
clr.AddReference("RevitNodes")
import Revit
import Revit.Elements.TextNote as tn
clr.ImportExtensions(Revit.Elements)
clr.AddReference("RevitServices")
import RevitServices
from RevitServices.Persistence import DocumentManager
from RevitServices.Transactions import TransactionManager
from System.Collections.Generic import *
import Autodesk.Revit.DB.JoinGeometryUtils as JGU
import time
#-----------------------------------------------------------------------#
def get_sheet_view_by_search_string(search_string):
    global doc    
    viewCollector = list(FilteredElementCollector(doc).OfClass(ViewSheet))
    try:
	    view_  = [v for v in viewCollector if search_string in v.Name][0]
	    return view_
    except:
    	return

#-----------------------------------------------------------------------#
debugger = []
doc = DocumentManager.Instance.CurrentDBDocument
uiapp = DocumentManager.Instance.CurrentUIApplication
app = uiapp.Application
opt = Options()
#-----------------------------------------------------------------------#
# The inputs to this node will be stored as a list in the IN variables.
dataEnteringNode = IN
data = IN[0]
dic = {"a":{"D10":10,"D16":16,"D20":20},
		"b":{"D10":11,"D16":17,"D20":21},
		"c":{"D10":12,"D16":18,"D20":22}}#IN[0]
#VIEW
view = IN[1]

# DATA REBAR WEIGHT
rb_data = IN[3][1:]
rb_types = ["D{:0.0f}".format(data[0]) for data in rb_data]

# WRITE TEXT
# POINT
point = pt.ByCoordinates(0,0) #START
# TEXT TO WRITE
dic_text={} # primitive
for ttt in rb_types:
    dic_text[ttt] = 0

new_dic = {}
for d in dic:
	new_dic[d] = {}
	new_d = dic_text.copy()
	new_d.update(dic[d])
	new_dic[d] = new_d

headers = "Category\t{}".format("\t".join([tt for tt in rb_types]))

content = []
content.append(headers)
for d in new_dic:
	content.append("{}\t{}".format(d,"\t".join([str(new_dic[d][dd]) for dd in new_dic[d]])))

text = "\n".join(content)#"\n".join(["\t".join([str(new_dic[d][dd]) for dd in new_dic[d]]) for d in new_dic])	
# ALIGN
align = "Left"
# TEXT TYPE

text_type = IN[2]
keep_rot = False
rot = 0
# WRITE
t= tn.ByLocation(view,point,text,align,text_type,keep_rot,rot)

OUT = headers
# ----------------------------------------
watch_2 = Watch(importExcel)
