# Dynamo graph revit_server.dyn (Dynamo 2.1.0.7500)

string = StringInput("1")
python_script = Python(IN[0]=string)
# ---------- python_script.python (19 lines) ----------
# Load the Python Standard and DesignScript Libraries
import sys
import clr
clr.AddReference('ProtoGeometry')
from Autodesk.DesignScript.Geometry import *

import time
# The inputs to this node will be stored as a list in the IN variables.
dataEnteringNode = IN
controller = IN[0]
# Place your code below this line

while True:
    time.sleep(3)
    if not controller.lower() == "q":
        OUT = "Looping at {}".format(time.strptime("%d/%m%y %H:%M:%S",time.localtime(time.time())))
    else:
        OUT = "End Loop"
        break
# ----------------------------------------
watch = Watch(python_script)
