# Dynamo graph Home.dyn (Dynamo 2.1.0.7500)

watch = Watch()  # unwired: arg0
select_model_element_revit_line = DSModelElementSelection()  # 1 picked in the model
curves = Element.Curves(element=select_model_element_revit_line)
endPoint = Curve.EndPoint(curve=curves)
panel_width = DoubleInput(1220)
pointsAtChordLengthFromPoint = Curve.PointsAtChordLengthFromPoint(curve=curves, point=endPoint, chordLength=panel_width)
panel_height = DoubleInput(-2440)
byCoordinates = Vector.ByCoordinates(z=panel_height)
translate = Geometry.Translate(geometry=pointsAtChordLengthFromPoint, direction=byCoordinates)
select_faces = SelectFaces()  # 3 picked in the model
select_face = DSFaceSelection()  # 1 picked in the model
code_block = CodeBlock(sf=select_face) { sf; }
code_block_2 = CodeBlock { 0; 0.25; 0.5; 0.75; 1; }
pointAtParameter = Surface.PointAtParameter(surface=code_block, u=code_block_2.out0, v=code_block_2.out0)
pointAtParameter_2 = Surface.PointAtParameter(surface=code_block, u=code_block_2.out1, v=code_block_2.out1)
pointAtParameter_3 = Surface.PointAtParameter(surface=code_block, u=code_block_2.out2, v=code_block_2.out2)
pointAtParameter_4 = Surface.PointAtParameter(surface=code_block, u=code_block_2.out3, v=code_block_2.out3)
pointAtParameter_5 = Surface.PointAtParameter(surface=code_block, u=code_block_2.out4, v=code_block_2.out4)
list_create = List.Create(item0=pointAtParameter, item1=pointAtParameter_2, item2=pointAtParameter_3, item3=pointAtParameter_4, item4=pointAtParameter_5)
code_block_3 = CodeBlock { 1; }
flatten = List.Flatten(list=list_create, amt=code_block_3)
byPoints = NurbsCurve.ByPoints(points=flatten)
normalAtParameter = Surface.NormalAtParameter(surface=code_block, u=code_block_2.out2, v=code_block_2.out2)
byPoints_2 = PolyCurve.ByPoints(points=flatten)
tangentAtParameter = Curve.TangentAtParameter(curve=byPoints_2, param=code_block_2.out2)
ZAxis = Vector.ZAxis()
code_block_4 = CodeBlock { 90; -90; 5000; }
rotate = Vector.Rotate(vector=tangentAtParameter, axis=ZAxis, degrees=code_block_4.out0)
scale = Vector.Scale(vector=rotate, scale_factor=code_block_4.out2)
translate_2 = Geometry.Translate(geometry=byPoints_2, direction=scale)
rotate_2 = Vector.Rotate(vector=tangentAtParameter, axis=ZAxis, degrees=code_block_4.out1)
scale_2 = Vector.Scale(vector=rotate_2, scale_factor=code_block_4.out2)
translate_3 = Geometry.Translate(geometry=byPoints_2, direction=scale_2)
list_create_2 = List.Create(item0=translate_2, item1=byPoints_2, item2=translate_3)
code_block_5 = CodeBlock { 1; }
flatten_2 = List.Flatten(list=list_create_2, amt=code_block_5)
byLoft = PolySurface.ByLoft(crossSections=flatten_2)
code_block_6 = CodeBlock { 0; 0; -1; }
byCoordinates_2 = Vector.ByCoordinates(x=code_block_6.out0, y=code_block_6.out1, z=code_block_6.out2)
project = Point.Project(point=pointsAtChordLengthFromPoint, baseGeometry=byLoft, projectionDirection=byCoordinates_2)
