# Dynamo graph TraiPhangView - 1.dyn "TraiPhangView - Copy" (Dynamo 2.1.0.7500)

tên_view_drafting = StringInput("Test")  # frozen
byName = DraftingView.ByName(name=tên_view_drafting)
code_block = CodeBlock { 0; -9000; }  # frozen
byCoordinates = Point.ByCoordinates(x=code_block.out0, y=code_block.out0)
byCoordinates_2 = Point.ByCoordinates(x=code_block.out1, y=code_block.out1)
byStartPointEndPoint = Line.ByStartPointEndPoint(startPoint=byCoordinates, endPoint=byCoordinates_2)
byCurve = DetailCurve.ByCurve(view=byName, curve=byStartPointEndPoint)
độ_cao_panel = DoubleInput(1220)
select_model_elements = DSModelElementsSelection()  # 4 picked in the model; frozen
độ_dài_panel = DoubleInput(1220)
số_đoạn_chia_càng_nhiều_càng = IntegerSlider(6, range=1..8 step 1)  # "Số đoạn chia, (càng nhiều càng chính xác)"; graph input
python_script = Python(IN[0]=select_model_elements, IN[1]=độ_dài_panel, IN[2]=số_đoạn_chia_càng_nhiều_càng)
# ---------- python_script.python (37 lines) ----------
# Load the Python Standard and DesignScript Libraries
import sys
import clr
clr.AddReference('ProtoGeometry')
from Autodesk.DesignScript.Geometry import *
# Import RevitNodes
clr.AddReference("RevitNodes")
import Revit
import Revit.Elements.Element as EL

# The inputs to this node will be stored as a list in the IN variables.
dataEnteringNode = IN
curves_main = IN[0]
seg_length = IN[1]
seg_count = IN[2]

if not curves_main.__class__.__name__ == "list":
	curves_main = [curves_main]
curves_main = [c for c in curves_main if c.__class__.__name__ == "ModelCurve"]
poly_curve = PolyCurve.ByJoinedCurves([c.Curves[0] for c in curves_main])
length = poly_curve.Length
curves = PolyCurve.Curves(poly_curve)


points = []
for c in curves:
	try:
		seg = c.Length / int(seg_count)
		points.append(c.StartPoint)
		points.extend(Curve.PointsAtChordLengthFromPoint(c,c.StartPoint,seg))
		points.append(c.EndPoint)
	except:
		pass


# Assign your output to the OUT variable.
OUT = poly_curve,length,curves,points
# ----------------------------------------
watch = Watch(python_script)
n1_chọn_outlines_trên_lưu_ý_ko_để = SelectEdges()  # "(1) Chọn Outlines Trên - Lưu ý ko để Section box cắt Outline"; 1 picked in the model; graph input
n2_chọn_outlines_dưới = SelectEdges()  # "(2) Chọn Outlines Dưới"; 1 picked in the model; graph input
python_script_2 = Python(IN[0]=n1_chọn_outlines_trên_lưu_ý_ko_để, IN[1]=n2_chọn_outlines_dưới, IN[2]=số_đoạn_chia_càng_nhiều_càng)
# ---------- python_script_2.python (81 lines) ----------
# Load the Python Standard and DesignScript Libraries
import sys
import clr
clr.AddReference('ProtoGeometry')
from Autodesk.DesignScript.Geometry import *
# clr.AddReference('RevitAPI')
# from Autodesk.Revit.DB import *
# clr.AddReference('RevitAPIUI')
# from Autodesk.Revit.UI import TaskDialog
clr.AddReference("RevitNodes")
import Revit
# clr.ImportExtensions(Revit.Elements)
# clr.AddReference("RevitServices")
# import RevitServices
# from RevitServices.Persistence import DocumentManager
# from RevitServices.Transactions import TransactionManager
# from System.Collections.Generic import *

# import Autodesk.Revit.DB.JoinGeometryUtils as JGU

import time

# The inputs to this node will be stored as a list in the IN variables.
dataEnteringNode = IN
curves_main = IN[0]
curve_sub = IN[1]
seg_count = IN[2]

if not curves_main.__class__.__name__ == "list":
	curves_main = [curves_main]


def flat_curves(curves_main,seg_count):
	curves_flat = []
	points = []
	points_flat = []
	detail_curves = []
	detail_points = []
	L_sum = 0

	x_start = curves_main[0].StartPoint.X
	y_start = curves_main[0].StartPoint.Y
	for c in curves_main:
		try:
			L = c.Length
			x_start = c.StartPoint.X
			y_start = c.StartPoint.Y			
			
			# chia doan
			seg = c.Length / int(seg_count)
			c_start = c.StartPoint
			c_end = c.EndPoint
			
			points.append(c_start)
			div_p = Curve.PointsAtChordLengthFromPoint(c,c.StartPoint,seg)
			points.extend(div_p)
			points.append(c_end)
			# collect points-flat
			for p in points:
				points_flat.append(Point.ByCoordinates(p.X,p.Z,0))

			try:
				c_flat = PolyCurve.ByPoints(points_flat)
			except:
				c_flat = Line.ByStartPointEndPoint(c.StartPoint,c.EndPoint)
			L_flat = c_flat.Length

			for i in range(len(points_flat)):
				p = points[i]
				pf = points_flat[i]
				detail_points.append(Point.ByCoordinates(L_sum + Curve.ParameterAtPoint(c_flat,pf)*L_flat,p.Z))
			
			# cộng dồn độ dài		
			L_sum += L_flat
		except Exception as ex:
			detail_points.append(ex)
			pass
	return detail_points

# Assign your output to the OUT variable.
OUT = flat_curves(curves_main,seg_count)
# ----------------------------------------
watch_2 = Watch(python_script_2)  # graph output
