# Dynamo graph TraiPhangView.dyn (Dynamo 2.1.0.7500)

watch = Watch()  # unwired: arg0
panel_height = DoubleInput(-2440)
byCoordinates = Vector.ByCoordinates(z=panel_height)
byCoordinates_2 = Point.ByCoordinates()
select_model_element_revit_line = DSModelElementSelection()  # 1 picked in the model
curves = Element.Curves(element=select_model_element_revit_line)
length = Curve.Length(curve=curves)
byCoordinates_3 = Point.ByCoordinates(x=length)
byStartPointEndPoint = Line.ByStartPointEndPoint(startPoint=byCoordinates_2, endPoint=byCoordinates_3)
panel_width = DoubleInput(1220)
pointsAtChordLengthFromPoint = Curve.PointsAtChordLengthFromPoint(curve=byStartPointEndPoint, point=byCoordinates_2, chordLength=panel_width)
startPoint = Curve.StartPoint(curve=curves)
select_face = DSFaceSelection()  # 1 picked in the model
code_block = CodeBlock(sf=select_face) { sf; }
code_block_2 = CodeBlock { 0; 0.25; 0.5; 0.75; 1; }
pointAtParameter = Surface.PointAtParameter(surface=code_block, u=code_block_2.out0, v=code_block_2.out0)
pointAtParameter_2 = Surface.PointAtParameter(surface=code_block, u=code_block_2.out1, v=code_block_2.out1)
pointAtParameter_3 = Surface.PointAtParameter(surface=code_block, u=code_block_2.out2, v=code_block_2.out2)
pointAtParameter_4 = Surface.PointAtParameter(surface=code_block, u=code_block_2.out3, v=code_block_2.out3)
pointAtParameter_5 = Surface.PointAtParameter(surface=code_block, u=code_block_2.out4, v=code_block_2.out4)
list_create = List.Create(item0=pointAtParameter, item1=pointAtParameter_2, item2=pointAtParameter_3, item3=pointAtParameter_4, item4=pointAtParameter_5)
code_block_3 = CodeBlock { 1; }
flatten = List.Flatten(list=list_create, amt=code_block_3)
byPoints = PolyCurve.ByPoints(points=flatten)
startPoint_2 = Curve.StartPoint(curve=byPoints)
byStartPointEndPoint_2 = Line.ByStartPointEndPoint(startPoint=startPoint, endPoint=startPoint_2)
length_2 = Curve.Length(curve=byStartPointEndPoint_2)
code_block_4 = CodeBlock(pt1=startPoint, pt2=startPoint_2) { h = Math.Abs(pt1.Z-pt2.Z); }
python_script = Python(IN[0]=length_2, IN[1]=code_block_4)
# ---------- python_script.python (13 lines) ----------
# Load the Python Standard and DesignScript Libraries
import sys
import clr
clr.AddReference('ProtoGeometry')
from Autodesk.DesignScript.Geometry import *

# The inputs to this node will be stored as a list in the IN variables.
dataEnteringNode = IN

# Place your code below this line

# Assign your output to the OUT variable.
OUT = round((float(IN[0][0])**2 - float(IN[1][0])**2)**0.5)
# ----------------------------------------
byCoordinates_4 = Point.ByCoordinates(x=python_script)
code_block_5 = CodeBlock(z=code_block_4) { -z; }
byCoordinates_5 = Vector.ByCoordinates(z=code_block_5)
translate = Geometry.Translate(geometry=byCoordinates_4, direction=byCoordinates_5)
length_3 = Curve.Length(curve=byPoints)
code_block_6 = CodeBlock(x=python_script, l=length_3) { x+l; }
byCoordinates_6 = Point.ByCoordinates(x=code_block_6)
endPoint = Curve.EndPoint(curve=curves)
endPoint_2 = Curve.EndPoint(curve=byPoints)
code_block_7 = CodeBlock(pt1=endPoint, pt2=endPoint_2) { h = Math.Abs(pt1.Z-pt2.Z); }
code_block_8 = CodeBlock(z=code_block_7) { -z; }
byCoordinates_7 = Vector.ByCoordinates(z=code_block_8)
translate_2 = Geometry.Translate(geometry=byCoordinates_6, direction=byCoordinates_7)
byStartPointEndPoint_3 = Line.ByStartPointEndPoint(startPoint=translate, endPoint=translate_2)
byCoordinates_8 = Vector.ByCoordinates(z=code_block_5)
project = Point.Project(point=pointsAtChordLengthFromPoint, baseGeometry=byStartPointEndPoint_3, projectionDirection=byCoordinates_8)
python_script_2 = Python(IN[0]=pointsAtChordLengthFromPoint, IN[1]=project)
# ---------- python_script_2.python (22 lines) ----------
# Load the Python Standard and DesignScript Libraries
import sys
import clr
clr.AddReference('ProtoGeometry')
from Autodesk.DesignScript.Geometry import *

# The inputs to this node will be stored as a list in the IN variables.
dataEnteringNode = IN

# Place your code below this line
res = []
for i in range(len(IN[0][0])):	
	try:
		p1 = IN[0][0][i]
		p2 = IN[1][0][i][0]
		res.append(Line.ByStartPointEndPoint(p1,p2))
	except:
		pass


# Assign your output to the OUT variable.
OUT = res
# ----------------------------------------
select_model_elements = DSModelElementsSelection()  # 4 picked in the model
segment_width = DoubleInput(1220)
integer_slider = IntegerSlider(4, range=1..8 step 1)
python_script_3 = Python(IN[0]=select_model_elements, IN[1]=segment_width, IN[2]=integer_slider)
# ---------- python_script_3.python (37 lines) ----------
# Load the Python Standard and DesignScript Libraries
import sys
import clr
clr.AddReference('ProtoGeometry')
from Autodesk.DesignScript.Geometry import *
# Import RevitNodes
clr.AddReference("RevitNodes")
import Revit
import Revit.Elements.Element as EL

# The inputs to this node will be stored as a list in the IN variables.
dataEnteringNode = IN
curves_main = IN[0]
seg_length = IN[1]
seg_count = IN[2]

if not curves_main.__class__.__name__ == "list":
	curves_main = [curves_main]
curves_main = [c for c in curves_main if c.__class__.__name__ == "ModelCurve"]
poly_curve = PolyCurve.ByJoinedCurves([c.Curves[0] for c in curves_main])
length = poly_curve.Length
curves = PolyCurve.Curves(poly_curve)


points = []
for c in curves:
	try:
		seg = c.Length / int(seg_count)
		points.append(c.StartPoint)
		points.extend(Curve.PointsAtChordLengthFromPoint(c,c.StartPoint,seg))
		points.append(c.EndPoint)
	except:
		pass


# Assign your output to the OUT variable.
OUT = poly_curve,length,curves,points
# ----------------------------------------
code_block_9 = CodeBlock(t1=select_model_element_revit_line) { curve1 = Element.Curves(t1); point1 = Curve.EndPoint(curve1); }
select_edges = SelectEdges()  # 2 picked in the model
python_script_4 = Python(IN[0]=select_edges, IN[1]=segment_width)
# ---------- python_script_4.python (32 lines) ----------
# Load the Python Standard and DesignScript Libraries
import sys
import clr
clr.AddReference('ProtoGeometry')
from Autodesk.DesignScript.Geometry import *
# Import RevitNodes
clr.AddReference("RevitNodes")
import Revit
import Revit.Elements.Element as EL

# The inputs to this node will be stored as a list in the IN variables.
dataEnteringNode = IN
curves_main = IN[0]
seg_length = IN[1]

if not curves_main.__class__.__name__ == "list":
	curves_main = [curves_main]

poly_curve = PolyCurve.ByJoinedCurves([c for c in curves_main])
length = poly_curve.Length
curves = PolyCurve.Curves(poly_curve)

points = []
for c in curves:
	try:
		points.append(c.StartPoint)
		points.extend(Curve.PointsAtChordLengthFromPoint(c,c.StartPoint,seg_length))
		points.append(c.EndPoint)
	except:
		pass
# Assign your output to the OUT variable.
OUT = poly_curve,length,curves,points
# ----------------------------------------
byName = DraftingView.ByName()  # unwired: name
code_block_10 = CodeBlock { "Test"; }
byName_2 = DraftingView.ByName(name=code_block_10)
code_block_11 = CodeBlock { 0; 1000; }
byCoordinates_9 = Point.ByCoordinates(x=code_block_11.out0, y=code_block_11.out0)
byCoordinates_10 = Point.ByCoordinates(x=code_block_11.out1, y=code_block_11.out1)
byStartPointEndPoint_4 = Line.ByStartPointEndPoint(startPoint=byCoordinates_9, endPoint=byCoordinates_10)
byCurve = DetailCurve.ByCurve(view=byName_2, curve=byStartPointEndPoint_4)
segment_height = DoubleInput(1220)
