# Dynamo graph Object-ID-Collector-211025.dyn (Dynamo 2.3.0.5885)

project_number = StringInput("VM")
categories = StringInput("""Structural Foundations
Structural Columns
Structural Framing
Walls
Floors
Roofs
Parts""")
string = StringInput("COF_CON__WorkItemNumber")
python_script = Python(IN[0]=project_number, IN[1]=categories, IN[2]=string)
# ---------- python_script.python (117 lines) ----------
# Load the Python Standard and DesignScript Libraries
import sys,os
import clr
clr.AddReference('ProtoGeometry')
from Autodesk.DesignScript.Geometry import *
clr.AddReference('RevitAPI')
from Autodesk.Revit.DB import *
clr.AddReference('RevitAPIUI')
from Autodesk.Revit.UI import TaskDialog
clr.AddReference("RevitNodes")
import Revit
clr.ImportExtensions(Revit.Elements)
clr.AddReference("RevitServices")
import RevitServices
from RevitServices.Persistence import DocumentManager
from RevitServices.Transactions import TransactionManager
from System.Collections.Generic import *
import Autodesk.Revit.DB.JoinGeometryUtils as JGU
import time

#start
time_start = time.strftime("%y%m%d %H:%M:%S",time.localtime(time.time()))
debugger = []
result = []

doc = DocumentManager.Instance.CurrentDBDocument
uiapp = DocumentManager.Instance.CurrentUIApplication
app = uiapp.Application
#functions
def setupUnit(doc):	
	try:
		#Area
		unit = Units(UnitSystem.Metric)		
		fmOp = FormatOptions(DisplayUnitType.DUT_SQUARE_METERS,UnitSymbolType.UST_NONE,0.001)		
		unit.SetFormatOptions(UnitType.UT_Area,fmOp)		
		doc.SetUnits(unit)
		#Volume
		unit1 = Units(UnitSystem.Metric)	
		fmOp1 = FormatOptions(DisplayUnitType.DUT_CUBIC_METERS,UnitSymbolType.UST_NONE,0.001)		
		unit.SetFormatOptions(UnitType.UT_Volume,fmOp1)		
		doc.SetUnits(unit)
		#doc.GetUnits().SetFormatOptions(UnitType.UT_Area,fmOp)
	except Exception as ex:
		pass
def revitDir(doc):
	dir = ""
	try:
		p = doc.PathName.split("\\")
		pp = p[0:len(p)-1]
	
		for s in pp:
			dir += s + "\\"
	except:
		pass
	return dir,doc.PathName.split("\\")[-1].split(".rvt")[0]
def getAllElementsOfCategories(doc,cates):
	global debugger
	categories = list(doc.Settings.Categories)
	category_names = [c.Name for c in categories]
	elements = []
	for cat in cates:
		try:
			if cat in category_names:
				c = categories[int(category_names.index(cat))]				
				elements.extend( [e for e in FilteredElementCollector(doc).OfCategoryId(c.Id).WhereElementIsNotElementType().ToElements()])
		except Exception as ex:
			debugger.append(ex)
			pass
	return elements

#excecute
cates = IN[1].splitlines()
project_number = IN[0]
param_name = IN[2]
elements = getAllElementsOfCategories(doc,cates)
for e in elements:
	try:
		debugger.append(e.UniqueId)

	except Exception as ex:
		pass

revit_dir = revitDir(doc)
file_name = revit_dir[1]+".rvt"
file_path = "{0}{1}.rvt".format(revit_dir[0],revit_dir[1])
revit_id_data_path = "{0}{1}-IdData.txt".format(revit_dir[0],revit_dir[1])

content = ""
list_ = []
try:
	param = elements[0].LookupParameter(param_name)
	if param.StorageType == StorageType.String:
		
		for elem in elements:
			try:
				par = elem.LookupParameter(param_name)				
				if par.AsString() != None:
					list_.append("{0}\t{1}\t{2}\t{3}".format(elem.UniqueId,par.AsString(),file_name,elem.Id))
			except:
				pass
		content = "\n".join(list_)
except:
	pass

# exists = None
# if os.path.exists(revit_id_data_path):
# 	with open(revit_id_data_path,"r") as ff:
# 		exists = [dict(line.split("\t")[0] = line.split("\t")[1]) for ff.readlines()]


with open(revit_id_data_path,"w") as f:
	f.write(content)

#end
time_end = time.strftime("%y%m%d %H:%M:%S",time.localtime(time.time()))

OUT = "{0}/{1} Succeeded".format(len(list_),len(elements)),time_start, time_end, debugger
# ----------------------------------------
watch = Watch(python_script)
