# Dynamo graph Object-ID-Overlapse Check-211025.dyn (Dynamo 2.3.0.5885)

string = StringInput("Y:\VIET MY\02 WIP\RVT")
python_script = Python(IN[0]=string)
# ---------- python_script.python (26 lines) ----------
# Load the Python Standard and DesignScript Libraries
import sys,os
import clr
clr.AddReference('ProtoGeometry')
from Autodesk.DesignScript.Geometry import *

# The inputs to this node will be stored as a list in the IN variables.
dataEnteringNode = IN
path_dir = IN[0]

list_ = []
for p in os.listdir(path_dir):	
	if p.split(".")[-1] == "txt":
		with open(path_dir+"\\"+p,"r") as f:
			[list_.append(line.strip()) for line in f.readlines()]
dict_ = {}

for l in list_:
	dict_[l.split("\t")[0]] = l.split("\t")[1:]

new_list_ = [d+"\t"+"\t".join(dict_[d]) for d in dict_]

overlapses = list(set(list_) - set(new_list_))

# Assign your output to the OUT variable.
OUT = "{0}/{1}".format(len(dict_),len(list_)), "{0} ID Overlapsed".format(round(len(dict_)-len(list_))),overlapses
# ----------------------------------------
watch = Watch(python_script)
