# Dynamo graph Road-220321.dyn (Dynamo 2.10.0.3455)

code_block = CodeBlock { 7000; 0.02; 0.04; 0.01; 0.05; }
inputs = CodeBlock(BeRongDuong=code_block.out0, DoDocTuTimDuong=code_block.out1, DoDocDocTimDuong=code_block.out2, DoDocToiThieu=code_block.out3, DoDocToiDa=code_block.out4) { BeRongDuong; DoDocTuTimDuong; DoDocDocTimDuong; DoDocToiThieu; DoDocToiDa; }
code_block_2 = CodeBlock { 0; 0; 0; 8000; 8000; }
byCoordinates = Point.ByCoordinates(x=code_block_2.out0, y=code_block_2.out1, z=code_block_2.out2)
byCoordinates_2 = Point.ByCoordinates(x=code_block_2.out3, y=code_block_2.out4, z=code_block_2.out2)
byStartPointEndPoint = Line.ByStartPointEndPoint(startPoint=byCoordinates, endPoint=byCoordinates_2)
code_block_3 = CodeBlock { -3000; -3000; 2700; }
code_block_4 = CodeBlock(CaoDoSanNenChuan=code_block_3.out2) { CaoDoSanNenChuan; }
byCoordinates_3 = Point.ByCoordinates(x=code_block_3.out0, y=code_block_3.out1, z=code_block_4)
code_block_5 = CodeBlock(cdsnc=code_block_4) { -3000..10000..300; -3000..10000..400; 2200..cdsnc..100; }
shuffle = List.Shuffle(list=code_block_5.out0)
shuffle_2 = List.Shuffle(list=code_block_5.out1)
shuffle_3 = List.Shuffle(list=code_block_5.out2)
code_block_6 = CodeBlock(CaoDoTracDac=shuffle_3) { CaoDoTracDac; }
byCoordinates_4 = Point.ByCoordinates(x=shuffle, y=shuffle_2, z=code_block_6, lacing=Shortest)
distanceTo = Geometry.DistanceTo(geometry=byCoordinates, other=byCoordinates_4)
minimumItem = List.MinimumItem(list=distanceTo)
indexOf = List.IndexOf(list=distanceTo, element=minimumItem)
distanceTo_2 = Geometry.DistanceTo(geometry=byCoordinates_2, other=byCoordinates_4)
minimumItem_2 = List.MinimumItem(list=distanceTo_2)
indexOf_2 = List.IndexOf(list=distanceTo_2, element=minimumItem_2)
point = CodeBlock(points=byCoordinates_4, indexMin=indexOf, indexMax=indexOf_2) { points; indexMin; indexMax; min = points[indexMin]; max = points[indexMax]; }
byStartPointEndPoint_2 = Line.ByStartPointEndPoint(startPoint=byCoordinates, endPoint=point.min)
byStartPointEndPoint_3 = Line.ByStartPointEndPoint(startPoint=byCoordinates_2, endPoint=point.min)
Z = Point.Z(point=point.min)
byStartPointEndPoint_4 = Line.ByStartPointEndPoint(startPoint=byCoordinates, endPoint=point.max)
byStartPointEndPoint_5 = Line.ByStartPointEndPoint(startPoint=byCoordinates_2, endPoint=point.max)
Z_2 = Point.Z(point=point.max)
