# Dynamo graph Script_1.dyn (Dynamo 2.1.0.7500)

file_path = Filename(".\VNM_Hanoi.488200_IWEC.epw")
string = StringInput("F:\_NGHIEN CUU\_Github\py_dynamo_revit\lady_bug\VNM_Hanoi.488200_IWEC.epw")
import_location = Custom[Import Location](epwFile=string)  # Import location. -
watch = Watch(import_location.location)
python_script = Python()  # unwired: IN[0]
# ---------- python_script.python (9 lines) ----------
import clr
from System import AppDomain, Environment, IO

clr.AddReference('ProtoGeometry')
_loc = tuple(a.Location for a in AppDomain.CurrentDomain.GetAssemblies() if 'ProtoGeometry' in a.FullName)



OUT = _loc
# ----------------------------------------
