# Dynamo graph Parameter-tranfer-Param-A-to-B-Category-211026.dyn (Dynamo 2.1.0.7500)

help = StringInput("""COF_GEN__Length
COF_GEN__Width
COF_GEN__Height
COF_GEN__Thickness
COF_GEN__Perimeter
COF_GEN__Area
COF_GEN__Volume
""")  # graph input
help_2 = StringInput("""Structural Foundations
Structural Framing
Structural Columns
Walls
Floors
Stairs
Parts
Generic Models
Curtain Panels
Roofs""")  # graph input
category = StringInput("""Structural Foundations
Structural Framing
Structural Columns
Walls
Floors
Stairs
Generic Models""")  # graph input
category_2 = StringInput("Floors")  # graph input
param_a = StringInput("Structural")  # graph input
param_b = StringInput("test_int")  # graph input
python_script = Python(IN[0]=category_2, IN[1]=param_a, IN[2]=param_b)
# ---------- python_script.python (117 lines) ----------
# Load the Python Standard and DesignScript Libraries
import sys
import clr
import math
clr.AddReference('ProtoGeometry')
from Autodesk.DesignScript.Geometry import *
clr.AddReference('RevitAPI')
from Autodesk.Revit.DB import *
clr.AddReference('RevitAPIUI')
from Autodesk.Revit.UI import TaskDialog
clr.AddReference("RevitNodes")
import Revit
clr.ImportExtensions(Revit.Elements)
clr.AddReference("RevitServices")
import RevitServices
from RevitServices.Persistence import DocumentManager
from RevitServices.Transactions import TransactionManager
from System.Collections.Generic import *
import Autodesk.Revit.DB.JoinGeometryUtils as JGU
import time
#----------------------------------------------------------------#
def setupUnit(doc):	
	try:
		#Area
		unit = Units(UnitSystem.Metric)		
		fmOp = FormatOptions(DisplayUnitType.DUT_SQUARE_METERS,UnitSymbolType.UST_NONE,0.001)		
		unit.SetFormatOptions(UnitType.UT_Area,fmOp)		
		doc.SetUnits(unit)
		#Volume
		unit1 = Units(UnitSystem.Metric)	
		fmOp1 = FormatOptions(DisplayUnitType.DUT_CUBIC_METERS,UnitSymbolType.UST_NONE,0.001)		
		unit.SetFormatOptions(UnitType.UT_Volume,fmOp1)		
		doc.SetUnits(unit)
	except Exception as ex:
		pass
def getAllElementsOfCategories(doc,cates):
	global debugger
	categories = list(doc.Settings.Categories)
	category_names = [c.Name for c in categories]
	elements = []
	for cat in cates:
		try:
			if cat in category_names:
				c = categories[int(category_names.index(cat))]
				elements.extend( [e for e in FilteredElementCollector(doc).OfCategoryId(c.Id).WhereElementIsNotElementType().ToElements()])
		except Exception as ex:
			debugger.append(ex)
			pass
	return elements


#----------------------------------------------------------------#
time_start = time.strftime("%y%m%d %H:%M:%S",time.localtime(time.time()))
debugger = []
cout_succeed = 0
result = []

doc = DocumentManager.Instance.CurrentDBDocument
uiapp = DocumentManager.Instance.CurrentUIApplication
app = uiapp.Application
opt = Options()



cates = IN[0].splitlines()
param_A = IN[1]
param_B = IN[2]

TransactionManager.Instance.EnsureInTransaction(doc)
setupUnit(doc)
elements = getAllElementsOfCategories(doc,cates)
for e in elements:
    try:
        par_A = e.LookupParameter(param_A)
        if par_A  == None:
        	par_A = doc.GetElement(e.GetTypeId()).LookupParameter(param_A)
        value = par_A.AsString()
        while value == None:
        	if par_A.StorageType == StorageType.Integer:
        		value = par_A.AsInteger()
        	elif par_A.DisplayUnitType == DisplayUnitType.DUT_DECIMAL_DEGREES or par_A.DisplayUnitType == DisplayUnitType.DUT_SLOPE_DEGREES:
    			value = par_A.AsValueString()[:-1]#round(par_A.AsDouble())
        	else:
        		value = par_A.AsValueString()#round(par_A.AsDouble()*304.8)
        		
        result.append(value)
        
        par_B = e.LookupParameter(param_B)
        if par_B.StorageType == StorageType.Double:
        	if par_B.DisplayUnitType == DisplayUnitType.DUT_CUBIC_METERS:
        		par_B.Set(float(value)/0.0283168)
    		elif par_B.DisplayUnitType == DisplayUnitType.DUT_SQUARE_METERS:
        		par_B.Set(float(value)/0.092903)
    		elif par_B.DisplayUnitType == DisplayUnitType.DUT_DECIMAL_DEGREES or par_B.DisplayUnitType == DisplayUnitType.DUT_SLOPE_DEGREES:
    			par_B.Set(math.radians(float(value)))
    		elif par_B.DisplayUnitType == DisplayUnitType.DUT_METERS:
    			par_B.Set((float(value)/304.8)/1000)
    		elif par_B.DisplayUnitType == DisplayUnitType.DUT_CENTIMETERS:
    			par_B.Set((float(value)/304.8)/10)
    		elif par_B.DisplayUnitType == DisplayUnitType.DUT_MILLIMETERS:
    			par_B.Set(float(value)/304.8)
    		else:
    			par_B.Set(float(value))
    	elif par_B.StorageType == StorageType.String:
        	par_B.Set(str(value))
    	elif par_B.StorageType == StorageType.Integer:
        	par_B.Set(int(value))
        cout_succeed += 1
    except Exception as ex:
        debugger.append("Exception in iterating elements : {}".format(ex))
        pass


TransactionManager.Instance.TransactionTaskDone()
time_end = time.strftime("%y%m%d %H:%M:%S",time.localtime(time.time()))

OUT = "{0}/{1} Succeeded".format(cout_succeed,len(elements)),time_start, time_end, elements, result, debugger
# ----------------------------------------
watch = Watch(python_script)
code_block = CodeBlock(res=python_script) { res[4]; }
watch_2 = Watch(code_block)
