# Dynamo graph Parameter_replace_value_string-(Select Elements)-211005.dyn "Parameter_replace_value_string-Select Elements)-211005" (Dynamo 2.1.0.7500)

select_model_elements = DSModelElementsSelection()  # nothing selected; graph input
parameter_string = StringInput("COF_CON__WorkItemNumber")  # graph input
value_replaced = StringInput("S-")  # graph input
replace_value = StringInput("")  # graph input
python_script = Python(IN[0]=select_model_elements, IN[1]=parameter_string, IN[2]=value_replaced, IN[3]=replace_value)
# ---------- python_script.python (52 lines) ----------
# Load the Python Standard and DesignScript Libraries
import sys
import clr
clr.AddReference('ProtoGeometry')
from Autodesk.DesignScript.Geometry import *
clr.AddReference('RevitAPI')
from Autodesk.Revit.DB import *
clr.AddReference('RevitAPIUI')
from Autodesk.Revit.UI import TaskDialog
clr.AddReference("RevitNodes")
import Revit
clr.ImportExtensions(Revit.Elements)
clr.AddReference("RevitServices")
import RevitServices
from RevitServices.Persistence import DocumentManager
from RevitServices.Transactions import TransactionManager
from System.Collections.Generic import *
import Autodesk.Revit.DB.JoinGeometryUtils as JGU
import time

#----------------------------------------------------------------#
time_start = time.strftime("%y%m%d %H:%M:%S",time.localtime(time.time()))
debugger = []
cout_succeed = 0

doc = DocumentManager.Instance.CurrentDBDocument
uiapp = DocumentManager.Instance.CurrentUIApplication
app = uiapp.Application
opt = Options()

elements = UnwrapElement(IN[0])
param_name = IN[1]
value_search = IN[2]
value_replace = IN[3]

TransactionManager.Instance.EnsureInTransaction(doc)
for e in elements:
    try:
        param = e.LookupParameter(param_name)
        if param.StorageType == StorageType.String:
            value_string = param.AsString()
            value_string = value_string.replace(value_search,value_replace)
            param.Set(value_string)
            cout_succeed += 1
    except Exception as ex:
        debugger.append("Exception in iterating elements : {}".format(ex))


TransactionManager.Instance.TransactionTaskDone()
time_end = time.strftime("%y%m%d %H:%M:%S",time.localtime(time.time()))

OUT = "{0}/{1} Succeeded".format(cout_succeed,len(elements)),time_start, time_end, debugger
# ----------------------------------------
watch = Watch(python_script)
