# Dynamo graph Rebar-Infomation-211129.dyn (Dynamo 2.1.0.7500)

python_script = Python()
# ---------- python_script.python (82 lines) ----------
# Load the Python Standard and DesignScript Libraries
import os, sys, json,clr, tempfile,shutil
from shutil import copyfile
clr.AddReference('ProtoGeometry')
from Autodesk.DesignScript.Geometry import *
clr.AddReference('RevitAPI')
from Autodesk.Revit.DB import *
from Autodesk.Revit.DB.Structure import *
clr.AddReference('RevitAPIUI')
from Autodesk.Revit.UI import TaskDialog
clr.AddReference("RevitNodes")
import Revit
clr.ImportExtensions(Revit.Elements)
clr.AddReference("RevitServices")
import RevitServices
from RevitServices.Persistence import DocumentManager
from RevitServices.Transactions import TransactionManager
from System.Collections.Generic import *

import Autodesk.Revit.DB.JoinGeometryUtils as JGU
import time
time_start = time.strftime("%y%m%d %H:%M:%S",time.localtime(time.time()))
debugger = []

#----------------------------------------------------------------#
#----------------------------------------------------------------#
#----------------------------------------------------------------#
#----------------------------------------------------------------#
#----------------------------------------------------------------#
#----------------------------------------------------------------#
def setupUnit(doc):	
	try:
		#Area
		unit = Units(UnitSystem.Metric)		
		fmOp = FormatOptions(DisplayUnitType.DUT_SQUARE_METERS,UnitSymbolType.UST_NONE,0.001)		
		unit.SetFormatOptions(UnitType.UT_Area,fmOp)		
		doc.SetUnits(unit)
		#Volume
		unit1 = Units(UnitSystem.Metric)	
		fmOp1 = FormatOptions(DisplayUnitType.DUT_CUBIC_METERS,UnitSymbolType.UST_NONE,0.001)		
		unit.SetFormatOptions(UnitType.UT_Volume,fmOp1)		
		doc.SetUnits(unit)
		#doc.GetUnits().SetFormatOptions(UnitType.UT_Area,fmOp)
	except Exception as ex:
		pass

#----------------------------------------------------------------#
#----------------------------------------------------------------#

def set_dic(selection):
    elem_dic = {}
    for e in selection:
        elem_dic[str(e.Id)] = []
        elem_dic[str(e.Id)].append(e)
    return elem_dic

#----------------------------------------------------------------#
#----------------------------------------------------------------#
def revitDir(doc):
	dir = ""
	try:
		p = doc.PathName.split("\\")
		pp = p[0:len(p)-1]
	
		for s in pp:
			dir += s + "\\"
	except:
		pass
	return dir,doc.PathName.split("\\")[-1].split(".rvt")[0]
#----------------------------------------------------------------#
#----------------------------------------------------------------#

#----------------------------------------------------------------#
doc = DocumentManager.Instance.CurrentDBDocument
uiapp = DocumentManager.Instance.CurrentUIApplication
app = uiapp.Application
opt = Options()
categories = list(doc.Settings.Categories)
category_names = [c.Name for c in categories]

# Assign your output to the OUT variable.
OUT =   "".join(revitDir(doc))+".xlsx"
# ----------------------------------------

# group: REBAR INFO EXTRACTING
categories = StringInput("""Structural Foundations
Structural Columns
Structural Framing
Floors
Walls
Parts""")  # graph input
file_path_database_rebar_excel = Filename(".\rebar_data.xlsx")  # "File Path-Database Rebar Excel file"; graph input
file_from_path = FileObject(path=file_path_database_rebar_excel)
code_block = CodeBlock { "Rebar Weight"; false; }
importExcel = Data.ImportExcel(file=file_from_path, sheetName=code_block.out0, readAsStrings=code_block.out1, showExcel=code_block.out1)

# group: """OUTS: [0] dic_cate_elements: Dictionary Category (Body Concrete) Elements [1] dic_cate_volume: Dictionary Category Volume (m3) [2] dic_cate_rebars: Dictionary Category (Rebar)elements [3] dic_cate_rebars_volume: Dictionary Category Rebar Volume (cm3) [4] dic_cate_rebars_weight: Dictionary Category Rebar Weight (Kg) [5] dic_cate_rebars_weight_per_type: Dictionary Category Rebar Weight per Type (Kg)(/Category/Type) [6] dic_cate_rebars_weight_ratio: Dictionary Category Rebar Weight Ratio (kg/m3)(/Category) [7] dic_cate_rebars_weight_ratio_per_type: Dictionary Category Elements (kg/m3)(/Category/Type) [8] dic_cate_rebars_length: Dictionary Category Rebar Length (m)(/Category) [9] dic_cate_rebars_length_per_type: Dictionary Category Rebar Length Per Type (m)(/Category/Type) [10] dic_cate_rebars_weight_ratio_per_type_combine: Dictionary Category Elements (kg/m3)(/Category/Type) Ex: {"D10;D20":"20;30"}
python_script_rebar_extractor = Python(IN[0]=categories, IN[1]=importExcel)
# ---------- python_script_rebar_extractor.python (403 lines) ----------
# Load the Python Standard and DesignScript Libraries
import os, sys, json,clr, tempfile,shutil
from shutil import copyfile
clr.AddReference('ProtoGeometry')
from Autodesk.DesignScript.Geometry import *
clr.AddReference('RevitAPI')
from Autodesk.Revit.DB import *
from Autodesk.Revit.DB.Structure import *
clr.AddReference('RevitAPIUI')
from Autodesk.Revit.UI import TaskDialog
clr.AddReference("RevitNodes")
import Revit
clr.ImportExtensions(Revit.Elements)
clr.AddReference("RevitServices")
import RevitServices
from RevitServices.Persistence import DocumentManager
from RevitServices.Transactions import TransactionManager
from System.Collections.Generic import *

import Autodesk.Revit.DB.JoinGeometryUtils as JGU
import time
time_start = time.strftime("%y%m%d %H:%M:%S",time.localtime(time.time()))
debugger = []

#----------------------------------------------------------------#
#----------------------------------------------------------------#
#----------------------------------------------------------------#
#----------------------------------------------------------------#
#----------------------------------------------------------------#
#----------------------------------------------------------------#
def setupUnit(doc):	
	try:
		#Area
		unit = Units(UnitSystem.Metric)		
		fmOp = FormatOptions(DisplayUnitType.DUT_SQUARE_METERS,UnitSymbolType.UST_NONE,0.001)		
		unit.SetFormatOptions(UnitType.UT_Area,fmOp)		
		doc.SetUnits(unit)
		#Volume
		unit1 = Units(UnitSystem.Metric)	
		fmOp1 = FormatOptions(DisplayUnitType.DUT_CUBIC_METERS,UnitSymbolType.UST_NONE,0.001)		
		unit.SetFormatOptions(UnitType.UT_Volume,fmOp1)		
		doc.SetUnits(unit)
		#doc.GetUnits().SetFormatOptions(UnitType.UT_Area,fmOp)
	except Exception as ex:
		pass

#----------------------------------------------------------------#
#----------------------------------------------------------------#

def set_dic(selection):
	elem_dic = {}
	for e in selection:
		try:
			elem_dic[str(e.Id)] = []
			elem_dic[str(e.Id)].append(e)
		except:
			pass
	return elem_dic

#----------------------------------------------------------------#
#----------------------------------------------------------------#
def revitDir(doc):
	dir = ""
	try:
		p = doc.PathName.split("\\")
		pp = p[0:len(p)-1]
	
		for s in pp:
			dir += s + "\\"
	except:
		pass
	return dir,doc.PathName.split("\\")[-1].split(".rvt")[0]
#----------------------------------------------------------------#
#----------------------------------------------------------------#
def getAllElementsOfCategories(doc,cates):
	global debugger,categories,category_names
	elements = []
	for cat in cates:
		try:
			if cat in category_names:
				c = categories[int(category_names.index(cat))]				
				elements.extend( [e for e in FilteredElementCollector(doc).OfCategoryId(c.Id).WhereElementIsNotElementType().ToElements()])
		except Exception as ex:
			debugger.append(ex)
			pass
	return elements

def getAllElementsOfCategory(doc,cat):
	global debugger,categories,category_names
	elements = []
	if cat in category_names:
		c = categories[int(category_names.index(cat))]				
		elements.extend( [e for e in FilteredElementCollector(doc).OfCategoryId(c.Id).WhereElementIsNotElementType().ToElements()])
	return elements
#----------------------------------------------------------------#
#----------------------------------------------------------------#
def get_rebar(e):
	# ALL REBAR IN MODEL
	# CHECK IF HOST REBAR
	elem_host_rebar = []
	try:
		rbhd = RebarHostData.GetRebarHostData(e)
		rebars = list(rbhd.GetRebarsInHost())
		if rebars:
			elem_host_rebar.extend(rebars)
	except Exception as ex:
		# elem_host_rebar.append(ex)
		pass
	return elem_host_rebar

def get_rebar_and_host(e):
	# ALL REBAR IN MODEL
	# CHECK IF HOST REBAR
	global doc
	elem_host_rebar = []
	try:
		rbhd = RebarHostData.GetRebarHostData(e)
		rebars = list(rbhd.GetRebarsInHost())
		if rebars:
			elem_host_rebar.extend(rebars)
	except Exception as ex:
		elem_host_rebar.append(ex)
		pass
	return e, elem_host_rebar

def rebar_in_system(floor):
	global doc,debugger
	rebars = []
	floor_id = floor.Id
	rebar_collector = []
	rebar_collector.extend(list(FilteredElementCollector(doc).OfClass(RebarInSystem).ToElements()))
	# rebar_collector.extend(list(FilteredElementCollector(doc).OfClass(Rebar).ToElements()))
	for r in rebar_collector:
		try:
			if r.GetHostId() == floor_id:
				rebars.append(r)
		except:
			pass		
	return rebars


def get_rebar_dic(e):
	"""
	[0] e : Đối tượng chứa Rebar
	[1] rebar_list :  Danh sách Rebar
	[2] rb_dic_volume : Dictionary Rebar: Volume
	[3] rb_dic_weight : Dictionary Rebar: Weight
	[4] rb_dic_length : Dictionary Rebar: Length"""
	# ALL REBAR IN MODEL
	# CHECK IF HOST REBAR
	global doc,debugger
	rebar_list = []
	try:
		rbhd = RebarHostData.GetRebarHostData(e)
		rebars = list(rbhd.GetRebarsInHost())
		debugger.append(rebars)
		if len(rebars)>0:
			rebar_list.extend(rebars)
		# RebarInSystem
		rebar_list.extend(rebar_in_system(e))
	except Exception as ex:
		debugger.append(ex)
		pass	
	rb_dic_volume = {}
	rb_dic_weight = {}
	rb_dic_length = {}

	for r in rebar_list:
		try:
			key = "D{:0.0f}".format(round(doc.GetElement(r.GetTypeId()).BarDiameter*304.8))
			# VOLUME
			if not key in rb_dic_volume.Keys:
				rb_dic_volume[key] = r.Volume*28316.8 # cubic feet to cubic centimet
			else:
				rb_dic_volume[key] += r.Volume*28316.8
			# WEIGHT
			if not key in rb_dic_weight:
				rb_dic_weight[key] = rebar_weight(r,rb_type = key)
			else:
				rb_dic_weight[key] += rebar_weight(r,rb_type = key)	
			# LENGTH
			if not key in rb_dic_length:
				rb_dic_length[key] = r.LookupParameter("Total Bar Length").AsDouble()*0.3048 # unit Meter
			else:
				rb_dic_length[key] += r.LookupParameter("Total Bar Length").AsDouble()*0.3048				
		except Exception as ex:
			debugger.append(ex)
			pass
	
	return e, rebar_list,rb_dic_volume,rb_dic_weight,rb_dic_length

def rebar_retriver(cates,rounding = 6):	
	"""cat_dic_rebar_ratio : Hàm lượng thép KG / M3 / Category
	cat_dic_rebar_type_ratio : Hàm lượng thép KG / M3 / Category / Rebar Type
	cat_dic_rebar_volume : Khối tích thép M3 / Category
	cat_dic_rebar_weight : Trọng lượng thép KG / Category/ Rebar Type"""
	global doc,debugger
	cat_dic_rebar_ratio = {} #dictionary rebar ratio{"Category": 10.02} kg/m3
	cat_dic_rebar_type_ratio = {} #dictionary rebar type ratio {"Category": {"D10":12,"D16":15}} kg/m3
	cat_dic_rebar_volume = {} # dictionnay rebar volume ex: {"Category": {"D 16": 1.2,"D 20": 2.3}} m3
	cat_dic_rebar_type_weight = {} # dictionnay rebar weight ex: {"Category": {"D 16": 25,"D 20": 30}} kg
	
	for cate in cates:
		cat_dic_rebar_ratio [cate] = 0
		cat_dic_rebar_volume[cate] = {} # ini dictionary of Category ex: {"Category":{}}
		cat_dic_rebar_type_weight[cate] = {}
		try:
			elements = getAllElementsOfCategory(doc,cate)
			volume_concrete_sum = 0
			rebars = [] # List of rebars
			rebars_volume_dics = [] # List of Dictionary for Rebar  volume
			rebars_weight_dics = [] # List of Dictionary for Rebar  Weight			
			for e in elements:
				try:
					rebar_host = get_rebar_dic(e)
					if len(rebar_host[1]) > 0:
						# rebars.extend(rebar_host[1])
						rebars_volume_dics.append(rebar_host[2])
						rebars_weight_dics.append(rebar_host[3])
						debugger.append("here")
						try:
							volume_concrete_sum += rebar_host[0].LookupParameter("Volume").AsDouble()
						except:
							pass
				except Exception as ex:
					pass
			debugger.append("here")
			# tính hàm lượng thép KG / M3 / Category
			# volume_rebar_sum = sum([r.Volume for r in rebars])
			weight_rebar_sum = sum([rebars_weight_dics[d] for d in rebars_weight_dics])
			cat_dic_rebar_ratio [cate] = round(weight_rebar_sum/volume_concrete_sum,rounding)
											
			
			for dic in rebars_volume_dics:				
				for d in dic:
					if not d in cat_dic_rebar_volume[cate].Keys:
						cat_dic_rebar_volume[cate][d] = dic[d]
					else:
						cat_dic_rebar_volume[cate][d] += dic[d]
			
			for dic in rebars_weight_dics:				
				for d in dic:
					if not d in cat_dic_rebar_type_weight[cate].Keys:
						cat_dic_rebar_type_weight[cate][d] = dic[d]
					else:
						cat_dic_rebar_type_weight[cate][d] += dic[d]
		

			for cate in cat_dic_rebar_type_weight:
				if not cate in cat_dic_rebar_type_weight.Keys:
					cat_dic_rebar_type_weight[cate] = {}
				for d in cat_dic_rebar_type_weight[cate]:
					try:
						if not d in cat_dic_rebar_type_weight[cate].Keys:
							cat_dic_rebar_type_weight[cate][d] = 0
						cat_dic_rebar_type_weight[cate][d] = cat_dic_rebar_type_weight[cate][d]/volume_concrete_sum
					except:
						pass

		
		except Exception as ex:
			# debugger.append(ex)
			pass
	return cat_dic_rebar_ratio,cat_dic_rebar_type_weight,cat_dic_rebar_volume,cat_dic_rebar_type_weight

def rebar_weight(e,rb_type = None):
	"""Trả về Khối lượng (Kg) Thép"""
	global rb_dic_WPL
	if e.__class__.__name__ == "Rebar" or e.__class__.__name__ == "RebarInSystem":
		if rb_type == None:
			rb_type = "D{:0.0f}".format(round(doc.GetElement(e.GetTypeId()).BarDiameter*304.8))
		# rn_quantity = e.Quantity
		# rb_each_bar_length = round(e.LookupParameter("Bar Length").AsDouble()*304.8)
		rb_total_bar_length = round(e.LookupParameter("Total Bar Length").AsDouble()*304.8)
		rb_total_weight = (rb_total_bar_length/1000)*rb_dic_WPL[rb_type]
		# debugger.append("Type: {}".format(rb_type))
		# debugger.append("Quantity: {}".format(rn_quantity))
		# debugger.append("Each Bar Length: {:0.0f} mm".format(rb_each_bar_length))
		# debugger.append("Total Bar Length: {:0.0f} mm".format(rb_total_bar_length))
		# debugger.append("Total Bar Weight: {:0.0f} kg".format(rb_total_weight))
		return rb_total_weight
def rebar_ratio(cates,rounding = 6):
	"""OUTS:
	[0] dic_cate_elements:	Dictionary Category (Body Concrete) Elements
	[1] dic_cate_volume:	Dictionary Category Volume (m3)
	[2] dic_cate_rebars:	Dictionary Category (Rebar)elements
	[3] dic_cate_rebars_volume:	Dictionary Category Rebar Volume (cm3)
	[4] dic_cate_rebars_weight:	Dictionary Category Rebar Weight (Kg)
	[5] dic_cate_rebars_weight_per_type:	Dictionary Category Rebar Weight per Type (Kg)(/Category/Type)
	[6] dic_cate_rebars_weight_ratio:	Dictionary Category Rebar Weight Ratio (kg/m3)(/Category)
	[7] dic_cate_rebars_weight_ratio_per_type:	Dictionary Category Elements (kg/m3)(/Category/Type)
	[8] dic_cate_rebars_length:	Dictionary Category Rebar Length (m)(/Category)
	[9] dic_cate_rebars_length_per_type:	Dictionary Category Rebar Length Per Type (m)(/Category/Type)"""
	global doc,debugger

	# OUT var

	dic_cate_elements = {}
	dic_cate_volume = {}
	dic_cate_rebars = {}
	dic_cate_rebars_volume = {}
	dic_cate_rebars_weight = {}
	dic_cate_rebars_weight_ratio = {}

	dic_cate_rebars_weight_per_type = {}
	dic_cate_rebars_weight_ratio_per_type = {}

	dic_cate_rebars_length = {}
	dic_cate_rebars_length_per_type = {}
	
	dic_cate_rebars_weight_ratio_per_type_combine = {}

	for cate in cates:
		elements = []

		dic_cate_elements[cate] = []
		dic_cate_volume[cate] = 0
		dic_cate_rebars[cate] = []
		dic_cate_rebars_volume[cate] = 0
		dic_cate_rebars_weight[cate] = 0
		dic_cate_rebars_weight_ratio[cate] = 0

		dic_cate_rebars_weight_per_type[cate] = {}
		dic_cate_rebars_weight_ratio_per_type[cate] = {}
		
		dic_cate_rebars_length[cate] = 0
		dic_cate_rebars_length_per_type[cate] = {}

		try:
			elements = getAllElementsOfCategory(doc,cate)			
		except:
			break
		for e in elements:
			try:
				rebars = get_rebar_dic(e)
				if len(rebars[1]) > 0:
					# OUT COLLECTING
					dic_cate_elements[cate].append(e)
					dic_cate_volume[cate] += e.LookupParameter("Volume").AsDouble()*0.0283168
					dic_cate_rebars[cate].extend(rebars[1])
					dic_cate_rebars_volume[cate] += sum([rebars[2][d] for d in rebars[2]])
					dic_cate_rebars_weight[cate] += sum([rebars[3][d] for d in rebars[3]])
					
					dic_cate_rebars_length[cate] += sum([rebars[4][d] for d in rebars[3]])

					for d in rebars[3]:
						if not d in dic_cate_rebars_weight_per_type[cate]:
							dic_cate_rebars_weight_per_type[cate][d] = rebars[3][d]
						else:
							dic_cate_rebars_weight_per_type[cate][d] += rebars[3][d]
							
						if not d in dic_cate_rebars_length_per_type[cate]:
							dic_cate_rebars_length_per_type[cate][d] = rebars[4][d]
						else:
							dic_cate_rebars_length_per_type[cate][d] += rebars[4][d]
						
			except:
				pass
		try:
			dic_cate_rebars_weight_ratio[cate] = dic_cate_rebars_weight[cate] / dic_cate_volume[cate]
		except:
			pass
		for d in dic_cate_rebars_weight_per_type[cate]:
			dic_cate_rebars_weight_ratio_per_type[cate][d] = round(dic_cate_rebars_weight_per_type[cate][d] / dic_cate_volume[cate],3)
		
		
		for cate in dic_cate_rebars_weight_ratio_per_type:		
			dic_cate_rebars_weight_ratio_per_type_combine[cate] = {} # Category
			dic = dic_cate_rebars_weight_ratio_per_type[cate]			
			key_8 = ";".join([str(d) for d in dic])
			value_8 = ";".join([str(dic[d]) for d in dic])				
			dic_cate_rebars_weight_ratio_per_type_combine[cate][key_8] = value_8
	
	return dic_cate_elements,dic_cate_volume, dic_cate_rebars,dic_cate_rebars_volume,dic_cate_rebars_weight,dic_cate_rebars_weight_per_type,dic_cate_rebars_weight_ratio,dic_cate_rebars_weight_ratio_per_type,dic_cate_rebars_length,dic_cate_rebars_length_per_type,dic_cate_rebars_weight_ratio_per_type_combine

#----------------------------------------------------------------#
doc = DocumentManager.Instance.CurrentDBDocument
uiapp = DocumentManager.Instance.CurrentUIApplication
app = uiapp.Application
opt = Options()
categories = list(doc.Settings.Categories)
category_names = [c.Name for c in categories]

# The inputs to this node will be stored as a list in the IN variables.
dataEnteringNode = IN
cates = IN[0].splitlines()
rb_data = IN[1][1:]

# Element Dictionary for quickly access
try:
	elem_dic = set_dic(selection)
except:
	pass
# rebar data dictionary
rb_dic_WPL = {} # Diction Weight per Length
for rd in rb_data:
	rb_dic_WPL["D{:0.0f}".format(rd[0])] = rd[1]
#----------------------------------------------------------------#
TransactionManager.Instance.EnsureInTransaction(doc)
setupUnit(doc)
TransactionManager.Instance.TransactionTaskDone()
#----------------------------------------------------------------#
OUT =  rebar_ratio(cates)
# ----------------------------------------

code_block_2 = CodeBlock(data=python_script_rebar_extractor) { "Rebar"; 0; data[1]; true; }  # frozen
python_script_2 = Python(IN[0]=code_block_2.out2)
# ---------- python_script_2.python (33 lines) ----------
# Load the Python Standard and DesignScript Libraries
import sys
import clr
clr.AddReference('ProtoGeometry')
from Autodesk.DesignScript.Geometry import *

# The inputs to this node will be stored as a list in the IN variables.
dataEnteringNode = IN
data = IN[0]

header = ["Category","D6","D8","D10","D12","D14","D16","D18","D20","D22","D24","D26","D28","D30","D32","D34","D36","D38","D40"]

write_data = []
write_data.append(header)

debugger = []

for cate in data:
	try:
		list_data = []
		list_data.append(cate)	
		for d in header[1:]:
			if d in data[cate].Keys:
				list_data.append(data[cate][d])
			else:
				list_data.append(0)
		write_data.append(list_data)	
	except:
		pass
# Place your code below this line

# Assign your output to the OUT variable.
OUT = write_data
# ----------------------------------------
exportExcel = Data.ExportExcel(filePath=python_script, sheetName=code_block_2.out0, startRow=code_block_2.out1, startCol=code_block_2.out1, data=python_script_2, overWrite=code_block_2.out3)

# group: [7] dic_cate_rebars_weight_ratio_per_type: Dictionary Category Elements (kg/m3)(/Category/Type)
code_block_3 = CodeBlock(KQ=python_script_rebar_extractor) { KQ[7]; }

watch = Watch(code_block_3)

# group: [6] dic_cate_rebars_weight_ratio: Dictionary Category Rebar Weight Ratio (kg/m3)(/Category)
code_block_4 = CodeBlock(KQ=python_script_rebar_extractor) { KQ[6]; }

watch_2 = Watch(code_block_4)
watch_3 = Watch(python_script_rebar_extractor)  # frozen

# group: WRITE TEXT NOTE
sheet_name = StringInput("REBAR INFORMATION")  # graph input
text_move = CodeBlock { 0; -60; -120; }
data_name = CodeBlock()
# ---------- data_name.designscript (3 lines) ----------
"Hàm lương thép (Kg/m3) / Category";
"Hàm lương thép (Kg/m3) / Category / Rebar Type";
"Hàm lương thép (Kg/m3) / Category / Rebar Type (Joined String)";
# ----------------------------------------
mode = CodeBlock { 1; 2; 3; 4; }

python_script_time_stamp = Python()
# ---------- python_script_time_stamp.python (5 lines) ----------
import time

time_start = time.strftime("%d-%m-%y %H:%M:%S",time.localtime(time.time()))

OUT = time_start
# ----------------------------------------

# group: dic_cate_rebars_weight_ratio_per_type_combine: Dictionary Category Elements (kg/m3)
code_block_5 = CodeBlock(KQ=python_script_rebar_extractor) { KQ[10]; }

# group: WRITE TEXT NOTE
# note: [0]: View Name
# [1]: Data (dict)
# [2]: Rebar Data (list from Excel)
# [3]: Textnote Y offset
# [4]: Data Name / Tittle
# [5]: Mode of converting data
# [6]: Time stamp
python_script_write_text_note = Python(IN[0]=sheet_name, IN[1]=code_block_4, IN[2]=importExcel, IN[3]=text_move.out0, IN[4]=data_name.out0, IN[5]=mode.out2, IN[6]=python_script_time_stamp)
# ---------- python_script_write_text_note.python (364 lines) ----------
# Load the Python Standard and DesignScript Libraries
import sys
import clr
clr.AddReference('ProtoGeometry')
from Autodesk.DesignScript.Geometry import *
import Autodesk.DesignScript.Geometry.Point as pt
clr.AddReference('RevitAPI')
from Autodesk.Revit.DB import *
clr.AddReference('RevitAPIUI')
from Autodesk.Revit.UI import TaskDialog
clr.AddReference("RevitNodes")
import Revit
import Revit.Elements.TextNote as tn
clr.ImportExtensions(Revit.Elements)
clr.AddReference("RevitServices")
import RevitServices
from RevitServices.Persistence import DocumentManager
from RevitServices.Transactions import TransactionManager
from System.Collections.Generic import *

import Autodesk.Revit.DB.JoinGeometryUtils as JGU

import time
clr.AddReference("Microsoft.Office.Interop.Excel")
import Microsoft.Office.Interop.Excel as Excel
#-------------------------------------------------------#
def get_sheet_view_by_search_string(search_string):
    global doc    
    viewCollector = list(FilteredElementCollector(doc).OfClass(ViewSheet))
    try:
	    view_  = [v for v in viewCollector if search_string in v.Name][0]
	    return view_
    except:
    	return

def get_sheet_view (view_name):
	""""""
	global doc#, debugger
	view_sheet = get_sheet_view_by_search_string(view_name)
	if view_sheet == None:
		try:
			# Get an available title block from document
			collector = list(FilteredElementCollector(doc).OfClass(FamilySymbol).OfCategory(BuiltInCategory.OST_TitleBlocks))
			fs = collector[0]#.FirstElement()		
			TransactionManager.Instance.EnsureInTransaction(doc)	
			view_sheet = ViewSheet.Create(doc,fs.Id)
			try:
				view_sheet.SheetNumber = "000"
			except:
				view_sheet.SheetNumber = "000000000000"
			view_sheet.Name = view_name
			# Delete Title Block
			title_blocks = list(FilteredElementCollector(doc,view_sheet.Id).OfCategory(BuiltInCategory.OST_TitleBlocks).WhereElementIsNotElementType().ToElements())
			[doc.Delete(t.Id) for t in title_blocks]
			TransactionManager.Instance.TransactionTaskDone()
		except Exception as ex:
			# debugger.append(ex)
			pass
	return view_sheet

def write_text_note(viewId,position,text,typeId):
	""""""
	global doc
	if doc.GetElement(viewId) == None:
		viewId = doc.ActiveView.Id
	if position == None:
		position = XYZ()
	if typeId ==  None or doc.GetElement(typeId) == None or not doc.GetElement(typeId).__class__ == TextNoteType:
		typeId = list(FilteredElementCollector(doc).OfClass(TextNoteType).WhereElementIsElementType())[0].Id
	
	TransactionManager.Instance.EnsureInTransaction(doc)

	text_note = TextNote.Create(doc,viewId,position,text,typeId = typeId)

	TransactionManager.Instance.TransactionTaskDone()
	return text_note
	
def dic_to_text(dic):
	"""
	print (dic_to_text({"D10":10,"D16":16,"D20":20}))
	---
	D10     10
	D16     16
	D20     20
	print (dic_to_text({"a":{"D10":10,"D16":16,"D20":20},
		"b":{"D10":11,"D16":17,"D20":21},
		"c":{"D10":12,"D16":18,"D20":22},
		"d":[1,2,3,4]}))
	---
	a       {'D10': 10, 'D16': 16, 'D20': 20}
	b       {'D10': 11, 'D16': 17, 'D20': 21}
	c       {'D10': 12, 'D16': 18, 'D20': 22}
	d       [1, 2, 3, 4]
	"""
	global time_start,data_name
	text = ""
	list_ = ["{0}\t{1}".format(d,dic[d]) for d in dic]
	list_.insert(0,time_start)
	list_.insert(0,data_name)
	text = "\n".join(list_)
	return text


def dic_to_text_2(dic):
	"""
	{"a":{"D10":10,"D16":16,"D20":20},
		"b":{"D10":11,"D16":17,"D20":21},
		"c":{"D10":12,"D16":18,"D20":22}}
	---
	a       10      16      20
	b       11      17      21
	c       12      18      22
	"""
	global time_start,data_name
	try:
		list_ = []
		list_.append(data_name)
		list_.append(time_start)
		for d in dic:
			l_ = []
			l_.append(str(d))
			l_.extend([str(dic[d][c]) for c in dic[d]])
			list_.append("\t".join(l_))
		return "\n".join(list_)
	except:
		return dic_to_text(dic)



def dic_to_text_3(dic,column_types,col_head_first = "Category"):
	"""
	dic (dict): Từ điển Dữ liệu Ex: {"a":{"D10":10,"D16":16,"D20":20},
									"b":{"D10":11,"D16":17,"D20":21},
									"c":{"D10":12,"D16":18,"D20":22}}
	column_types (list): Danh sách Tên cột  Ex: ["D10","D12","D14","D16","D18"]
	---
	Category        D10     D12     D14     D16     D18
	a       10      0       0       16      0       20
	b       11      0       0       17      0       21
	c       12      0       0       18      0       22
	"""
	global time_start,data_name
	try:
		dic_text={} # primitive Column head
		for ttt in column_types:
			dic_text[ttt] = 0
		new_dic = {}

		for d in dic:
			new_dic[d] = {}
			new_d = dic_text.copy()
			new_d.update(dic[d])
			new_dic[d] = new_d
		headers = "{0}\t{1}".format(col_head_first,"\t".join([tt for tt in column_types]))
		content = []
		content.append(data_name)
		content.append(time_start)
		content.append(headers)

		for d in new_dic:
			content.append("{}\t{}".format(d,"\t".join([str(new_dic[d][dd]) for dd in new_dic[d]])))
		text = "\n".join(content)
		return text
	except:
		return dic_to_text(dic)

def dic_to_text_4(dic):
	"""
	{"a":{"D10;D11":"10;12"},
		"b":{"D10;D11":"11;12"},
		"c":{"D10;D11":"12;12"}}
	---
	a       D10;D11      10;12
	b       D10;D11      11;12
	c       D10;D11      12;12
	"""
	global time_start,data_name,debugger
	try:
		list_ = []
		list_.append(data_name)
		list_.append(time_start)
		for d in dic:
			item_str = ""
			for c in dic[d]:			
				item_str = "{0}\t{1}".format(c,dic[d][c])
			join_str = "{0}\t{1}".format(d,item_str)			
			list_.append(join_str)			
		return "\n".join(list_)
	except Exception as ex:
		return dic_to_text(dic)

def dictionary_to_dict(dic):
	"""Use for converting Dynamo Dictionary to Python dict
	Apply for {'key':{'key':{}}}
	"""	
	if dic.__class__.__name__ == "Dictionary[object, object]":
		dic = dict(dic)		
	try:
		for d in dic:			
			if dic[d].__class__.__name__ == "Dictionary[object, object]":
				dic[d] = dict(dic[d])
			try:
				for c in dic[d]:
					if dic[d][c].__class__.__name__ == "Dictionary[object, object]":
						dic[d][c] = dict(dic[d][c])
			except:
				pass
	except:
		pass
	return dic


def write_excel_2(file_name,dir_path,sheet_name,row,column,data):
	global debugger
	time_ = time.strftime("%y%m%d %H%M%S",time.localtime(time.time()))
	excel_path = "{0}-{1}{2}".format("\\".join([dir_path,file_name]),time_ ,".xlsx")
	
	excel_app = Excel.ApplicationClass()
	excel_app.Visible = True	
	active_workbook = excel_app.ActiveWorkbook
	if active_workbook == None:
		excel_app.Workbooks.Add()
		active_workbook = excel_app.ActiveWorkbook

	worksheets = active_workbook.Worksheets
	if not sheet_name in [worksheets(i+1).Name for i in range(worksheets.Count)]:
		sheet = worksheets.Add()
		sheet.Name = sheet_name
	else:
		sheet = [worksheets(i+1) for i in range(worksheets.Count) if worksheets(i+1).Name == sheet_name][0]
	# WRITE DATA
	if data.__class__.__name__ == "str":
		sheet.Cells(row,column).Value = data
	if data.__class__.__name__ == "list":
		for d in data:
			if not d.__class__.__name__ == "list":
				sheet.Cells(row + data.index(d),column).Value = d
			else:
				for c in d:
					sheet.Cells(row + data.index(d),column + d.index(c)).Value = c
	if data.__class__.__name__ == "dict":
		keys = sorted(data) #list
		for k in keys:
			r = keys.index(k)
			c = 1
			sheet.Cells(row + r,column).Value = k			
			if data[k].__class__.__name__ in ["str","float"] :
				sheet.Cells(row + r,column + c).Value = data[k]
			# if data[d].__class__.__name__ == "dict":
			# 	sheet.Cells(row + r,column).Value = data[d]	
	
	# save then close
	active_workbook.SaveAs(Filename = excel_path)
	# active_workbook.Close()
	# excel_app.Quit()
	return 0

def dic_to_list(dic,column_types,col_head_first = "Category"):
	"""
	dic (dict): Từ điển Dữ liệu Ex: {"a":{"D10":10,"D16":16,"D20":20},
									"b":{"D10":11,"D16":17,"D20":21},
									"c":{"D10":12,"D16":18,"D20":22}}
	column_types (list): Danh sách Tên cột  Ex: ["D10","D12","D14","D16","D18"]
	---
	[['Category', 'D10', 'D12', 'D14', 'D16', 'D18']
	['a', 10, 0, 0, 16, 0, 20]
	['b', 11, 0, 0, 17, 0, 21]
	['c', 12, 0, 0, 18, 0, 22]]
	"""
	global time_start,data_name
	try:
		if not dic.__class__.__name__ == "dict": # verify if dic not dict
			raise Exception("Not dict")
		column_types = sorted([str(i) for i in column_types]) # ensure sorted list of strng
		content = []
		content.append(data_name)
		content.append(time_start)

		headers = []
		headers.append(col_head_first)
		headers.extend(column_types)

		content.append(headers)
		keys = sorted(dic)

		dic_text={} # primitive Column head
		for ttt in column_types:
			dic_text[ttt] = 0
		new_dic = {}

		for d in keys:
			try:
				line = []
				line.append(d) # Category
				
				new_d = dic_text.copy()
				new_d.update(dic[d])
				# new_dic[d] = new_d
				line.extend([new_d[w] for w in sorted(new_d)]) # rebar weight ratio / category / type
				content.append(line)
			except:
				pass		
		return content
	except:
		return sorted(dic)
def revitDir(doc):
	"""
	dir : directory
	file_name : Revit file name
	"""
	dir = ""
	try:
		p = doc.PathName.split("\\")
		pp = p[0:len(p)-1]	
		for s in pp:
			dir += s + "\\"
		file_name = doc.PathName.split("\\")[-1].split(".rvt")[0]	
	except:
		pass
	return dir,file_name
#-------------------------------------------------------#
#-------------------------------------------------------#
#-------------------------------------------------------#
dataEnteringNode = IN
debugger = []
doc = DocumentManager.Instance.CurrentDBDocument
uiapp = DocumentManager.Instance.CurrentUIApplication
app = uiapp.Application
opt = Options()
#-------------------------------------------------------#
dataEnteringNode = IN
view_name = IN[0]
data = dictionary_to_dict(IN[1])
rb_data = IN[2][1:]
y = float(IN[3])/304.8
data_name = IN[4]
mode = int(IN[5])
#-------------------------------------------------------#
time_start = IN[6]#time.strftime("%d-%m-%y %H:%M:%S",time.localtime(time.time()))

rb_types = ["D{:0.0f}".format(dat[0]) for dat in rb_data]

rvt_dir, rvt_file = revitDir(doc)
file_name = rvt_file +"-"+view_name+"-"+time_start+".xlsx"
dir_path = rvt_dir
sheet_name = view_name

viewId = get_sheet_view (view_name).Id
if mode == 1:
	text = dic_to_text(data)
if mode == 2:
	text = dic_to_text_2(data)
if mode == 3:
	text = dic_to_text_3(data,rb_types)
	# write_excel_2(file_name,dir_path,sheet_name,1,1,dic_to_list(data,rb_types))
if mode == 4:
	text = dic_to_text_4(data)
	# write_excel_2(file_name,dir_path,sheet_name,1,1,data)

text_note = write_text_note(viewId,XYZ(0,y,0),text,None)
if text_note:
	OUT = data
else:
	OUT = "FAIL"
# ----------------------------------------
python_script_write_text_note_2 = Python(IN[0]=sheet_name, IN[1]=code_block_3, IN[2]=importExcel, IN[3]=text_move.out1, IN[4]=data_name.out1, IN[5]=mode.out2, IN[6]=python_script_time_stamp)  # same code as python_script_write_text_note
python_script_write_text_note_3 = Python(IN[0]=sheet_name, IN[1]=code_block_5, IN[2]=importExcel, IN[3]=text_move.out2, IN[4]=data_name.out2, IN[5]=mode.out3, IN[6]=python_script_time_stamp)  # same code as python_script_write_text_note

watch_4 = Watch(python_script_write_text_note)
watch_5 = Watch(python_script_write_text_note_2)
watch_6 = Watch(python_script_write_text_note_3)

# group: test Dictionary to dict
watch_7 = Watch(code_block_5)  # frozen
python_script_3 = Python(IN[0]=watch_7)
# ---------- python_script_3.python (82 lines) ----------
def dic_to_text(dic):
	"""
	print (dic_to_text({"D10":10,"D16":16,"D20":20}))
	---
	D10     10
	D16     16
	D20     20
	print (dic_to_text({"a":{"D10":10,"D16":16,"D20":20},
		"b":{"D10":11,"D16":17,"D20":21},
		"c":{"D10":12,"D16":18,"D20":22},
		"d":[1,2,3,4]}))
	---
	a       {'D10': 10, 'D16': 16, 'D20': 20}
	b       {'D10': 11, 'D16': 17, 'D20': 21}
	c       {'D10': 12, 'D16': 18, 'D20': 22}
	d       [1, 2, 3, 4]
	"""
	text = ""
	text = "\n".join(["{0}\t{1}".format(d,dic[d]) for d in dic])
	return text
def dic_to_text_4(dic):
	"""
	{"a":{"D10;D11":"10;12"},
		"b":{"D10;D11":"11;12"},
		"c":{"D10;D11":"12;12"}}
	---
	a       D10;D11      10;12
	b       D10;D11      11;12
	c       D10;D11      12;12
	"""
	global debugger
	try:
		list_ = []
		for d in dic:
			item_str = ""
			if not dic[d][''] == '':				
				for c in dic[d]:
					debugger.append(dic[d][c])
				#item_str = "{0}\t{1}".format(str(c),str(dic[d][c]))
			join_str = "{0}\t{1}".format(str(d),item_str)			
			list_.append(join_str)
		return "\n".join(list_)
	except Exception as ex:
		return dic_to_text(dic)

debugger = []


d5 = {"Walls"	:{},
"Structural Framing"	:{'D8;D10;D12;D16;D25;D28' : '7.8;26.033;139.579;14.662;226.598;187.309'},
"Parts"	:{'':''},
"Floors"	:{'D10' : '109.119'},
"Structural Foundations"	:{'D10;D12;D8' : '2.169;5.279;0.438'},
"Structural Columns"	:{'D16;D8' : '100.331;34.05'}}

dic = IN[0]

def dictionary_to_dict(dic):
	"""Use for converting Dynamo Dictionary to Python dict
	Apply for {'key':{'key':{}}}
	"""	
	if dic.__class__.__name__ == "Dictionary[object, object]":
		dic = dict(dic)		
	try:
		for d in dic:			
			if dic[d].__class__.__name__ == "Dictionary[object, object]":
				dic[d] = dict(dic[d])
			try:
				for c in dic[d]:
					if dic[d][c].__class__.__name__ == "Dictionary[object, object]":
						dic[d][c] = dict(dic[d][c])
			except:
				pass
	except:
		pass
	return dic

dic = dictionary_to_dict(dic)
OUT = [dic[d].__class__.__name__ for d in dic]

#OUT = dic.__class__.__name__,dic["Parts"].__class__.__name__, dict(IN[0]["Parts"]).__class__.__name__
#[c for c in dic]#IN[0]["Parts"]]
# ----------------------------------------
watch_8 = Watch(python_script_3)
count = DesignScript.Builtin.Dictionary.Count(dictionary=watch_7)
keys = DesignScript.Builtin.Dictionary.Keys(dictionary=watch_7)
values = DesignScript.Builtin.Dictionary.Values(dictionary=watch_7)

excel_sheet_name = CodeBlock { "Cate_Ratio"; "Cate_RbType_Ratio"; "Cate_RbType_Ratio_JSTR"; }

# group: WRITE EXCEL
list_create = List.Create(item0=python_script_write_text_note, item1=python_script_write_text_note_2, item2=python_script_write_text_note_3)
# note: [0]: View Name
# [1]: Data (list[dict])
# [2]: Rebar Data (list from Excel)
# [3]: Sheet Name (list[str])
# [4]: Time stamp
list_create_2 = List.Create(item0=excel_sheet_name.out0, item1=excel_sheet_name.out1, item2=excel_sheet_name.out2)
list_create_3 = List.Create(item0=data_name.out0, item1=data_name.out1, item2=data_name.out2)
python_script_write_excel = Python(IN[0]=sheet_name, IN[1]=list_create, IN[2]=importExcel, IN[3]=list_create_2, IN[4]=python_script_time_stamp, IN[5]=list_create_3)
# ---------- python_script_write_excel.python (244 lines) ----------
# Load the Python Standard and DesignScript Libraries
import sys,os
import clr
clr.AddReference('ProtoGeometry')
from Autodesk.DesignScript.Geometry import *
import Autodesk.DesignScript.Geometry.Point as pt
clr.AddReference('RevitAPI')
from Autodesk.Revit.DB import *
clr.AddReference('RevitAPIUI')
from Autodesk.Revit.UI import TaskDialog
clr.AddReference("RevitNodes")
import Revit
import Revit.Elements.TextNote as tn
clr.ImportExtensions(Revit.Elements)
clr.AddReference("RevitServices")
import RevitServices
from RevitServices.Persistence import DocumentManager
from RevitServices.Transactions import TransactionManager
from System.Collections.Generic import *

import Autodesk.Revit.DB.JoinGeometryUtils as JGU

import time
clr.AddReference("Microsoft.Office.Interop.Excel")
import Microsoft.Office.Interop.Excel as Excel
#-------------------------------------------------------#

def write_excel_2(file_name,dir_path,sheet_name,row,column,data):
	global debugger
	excel_path = "{0}{1}".format("\\".join([dir_path,file_name]),".xlsx")	
	excel_app = Excel.ApplicationClass()
	excel_app.Visible = True	
	active_workbook = excel_app.ActiveWorkbook
	if active_workbook == None:
		excel_app.Workbooks.Add()
		active_workbook = excel_app.ActiveWorkbook
	worksheets = active_workbook.Worksheets
	if not sheet_name in [worksheets(i+1).Name for i in range(worksheets.Count)]:
		sheet = worksheets.Add()
		sheet.Name = sheet_name
	else:
		sheet = [worksheets(i+1) for i in range(worksheets.Count) if worksheets(i+1).Name == sheet_name][0]
	# WRITE DATA
	if data.__class__.__name__ == "str":
		sheet.Cells(row,column).Value = data
	if data.__class__.__name__ == "list":
		for d in data:
			if not d.__class__.__name__ == "list":
				sheet.Cells(row + data.index(d),column).Value = d
			else:
				for c in d:
					sheet.Cells(row + data.index(d),column + d.index(c)).Value = c
	if data.__class__.__name__ == "dict":
		keys = sorted(data) #list
		for k in keys:
			r = keys.index(k)
			c = 1
			sheet.Cells(row + r,column).Value = k			
			if data[k].__class__.__name__ in ["str","float"] :
				sheet.Cells(row + r,column + c).Value = data[k]
			# if data[d].__class__.__name__ == "dict":
			# 	sheet.Cells(row + r,column).Value = data[d]	
	
	# save then close
	if os.path.isfile(excel_path):
		active_workbook.Save()
	else:
		active_workbook.SaveAs(Filename = excel_path)

	active_workbook.Close()
	excel_app.Quit()
	return 0
def write_excel_3(file_name,dir_path,sheet_names,row,column,datas):
	global debugger
	excel_path = "{0}{1}".format("\\".join([dir_path,file_name]),".xlsx")	
	excel_app = Excel.ApplicationClass()
	excel_app.Visible = True	
	active_workbook = excel_app.ActiveWorkbook
	if active_workbook == None:
		excel_app.Workbooks.Add()
		active_workbook = excel_app.ActiveWorkbook
	worksheets = active_workbook.Worksheets
	# WRITE DATA
	if len(datas) == len(sheet_names):
		for data in datas:
			sheet_name = sheet_names[datas.index(data)]
			if not sheet_name in [worksheets(i+1).Name for i in range(worksheets.Count)]:
				sheet = worksheets.Add()
				sheet.Name = sheet_name
			else:
				sheet = [worksheets(i+1) for i in range(worksheets.Count) if worksheets(i+1).Name == sheet_name][0]
			if data.__class__.__name__ == "str":
				sheet.Cells(row,column).Value = data
			if data.__class__.__name__ == "list":
				for d in data:
					if not d.__class__.__name__ == "list":
						sheet.Cells(row + data.index(d),column).Value = d
					else:
						for c in d:
							sheet.Cells(row + data.index(d),column + d.index(c)).Value = c
			if data.__class__.__name__ == "dict":
				keys = sorted(data) #list
				for k in keys:
					r = keys.index(k)
					c = 1
					sheet.Cells(row + r,column).Value = k			
					if data[k].__class__.__name__ in ["str","float"] :
						sheet.Cells(row + r,column + c).Value = data[k]
					# if data[d].__class__.__name__ == "dict":
					# 	sheet.Cells(row + r,column).Value = data[d]	
			
		# save then close
		# if os.path.isfile(excel_path):
		# 	active_workbook.Save()
		# else:
		active_workbook.SaveAs(Filename = excel_path)

		active_workbook.Close()
		excel_app.Quit()
	return 0
def dic_to_list(dic,column_types,col_head_first = "Category"):
	"""
	dic (dict): Từ điển Dữ liệu Ex: {"a":{"D10":10,"D16":16,"D20":20},
									"b":{"D10":11,"D16":17,"D20":21},
									"c":{"D10":12,"D16":18,"D20":22}}
	column_types (list): Danh sách Tên cột  Ex: ["D10","D12","D14","D16","D18"]
	---
	[['Category', 'D10', 'D12', 'D14', 'D16', 'D18']
	['a', 10, 0, 0, 16, 0, 20]
	['b', 11, 0, 0, 17, 0, 21]
	['c', 12, 0, 0, 18, 0, 22]]
	"""
	global time_start,data_name
	try:
		if not dic.__class__.__name__ == "dict": # verify if dic not dict
			raise Exception("Not dict")
		column_types = sorted([str(i) for i in column_types]) # ensure sorted list of strng
		content = []
		content.append(data_name)
		content.append(time_start)

		headers = []
		headers.append(col_head_first)
		headers.extend(column_types)

		content.append(headers)
		keys = sorted(dic)

		dic_text={} # primitive Column head
		for ttt in column_types:
			dic_text[ttt] = 0
		new_dic = {}

		for d in keys:
			try:
				line = []
				line.append(d) # Category
				
				new_d = dic_text.copy()
				new_d.update(dic[d])
				# new_dic[d] = new_d
				line.extend([new_d[w] for w in sorted(new_d)]) # rebar weight ratio / category / type
				content.append(line)
			except:
				pass		
		return content
	except:
		return sorted(dic)
def revitDir(doc):
	"""
	dir : directory
	file_name : Revit file name
	"""
	dir = ""
	try:
		p = doc.PathName.split("\\")
		pp = p[0:len(p)-1]	
		for s in pp:
			dir += s + "\\"
		file_name = doc.PathName.split("\\")[-1].split(".rvt")[0]	
	except:
		pass
	return dir,file_name
def dictionary_to_dict(dic):
	"""Use for converting Dynamo Dictionary to Python dict
	Apply for {'key':{'key':{}}}
	"""	
	if dic.__class__.__name__ == "Dictionary[object, object]":
		dic = dict(dic)		
	try:
		for d in dic:			
			if dic[d].__class__.__name__ == "Dictionary[object, object]":
				dic[d] = dict(dic[d])
			try:
				for c in dic[d]:
					if dic[d][c].__class__.__name__ == "Dictionary[object, object]":
						dic[d][c] = dict(dic[d][c])
			except:
				pass
	except:
		pass
	return dic
#-------------------------------------------------------#
#-------------------------------------------------------#
#-------------------------------------------------------#
dataEnteringNode = IN
debugger = []
doc = DocumentManager.Instance.CurrentDBDocument
uiapp = DocumentManager.Instance.CurrentUIApplication
app = uiapp.Application
opt = Options()
#-------------------------------------------------------#
dataEnteringNode = IN
view_name = IN[0]
data = [dictionary_to_dict(dic) for dic in IN[1]] # data = list[dict]
rb_data = IN[2][1:]
sheet_names = IN[3] # list[str] sheet Name
time_start = time.strftime("%y%m%d %H%M%S",time.strptime(IN[4],"%d-%m-%y %H:%M:%S"))#time.strftime("%d-%m-%y %H:%M:%S",time.localtime(time.time()))
data_names = IN[5]
#-------------------------------------------------------#

rb_types = ["D{:0.0f}".format(dat[0]) for dat in rb_data]

rvt_dir, rvt_file = revitDir(doc)
file_name = rvt_file +"-"+view_name+"-"+time_start+".xlsx"
dir_path = rvt_dir[:-1]

if len(data) == len(sheet_names) == len(data_names):
	datas = []
	data_name = data_names[0]
	datas.append(data[0])
	data_name = data_names[1]
	datas.append(dic_to_list(data[1],rb_types))
	data_name = data_names[2]
	datas.append(data[2])
	
	write_excel_3(file_name,dir_path,sheet_names,1,1,datas)
	
	# write_excel_2(file_name,dir_path,sheet_names[0],1,1,data[0])
	# write_excel_2(file_name,dir_path,sheet_names[2],1,1,dic_to_list(data[1],rb_types))
	# write_excel_2(file_name,dir_path,sheet_names[2],1,1,data[2])


OUT = data.__class__.__name__,dir_path,file_name,sheet_names,time_start
# ----------------------------------------
