# Dynamo graph Home.dyn (Dynamo 2.1.0.7500)

integer_slider = IntegerSlider(10, range=1..20 step 1)
integer_slider_2 = IntegerSlider(16, range=1..20 step 1)
integer_slider_3 = IntegerSlider(12, range=1..20 step 1)
byCoordinates = Point.ByCoordinates(x=integer_slider, y=integer_slider_2, z=integer_slider_3)
byGeometry = Topologic.Topology.ByGeometry(geometry=byCoordinates)
geometry = Topologic.Topology.Geometry(topology=byGeometry)
watch = Watch(geometry)
